# Grasshopper definition DelRocco-Molton-moodswing-facade.gh (Grasshopper 1.0.7)

right_triangle = Slider(0, range=0..180)
top_triangle = Slider(0, range=0..180)
left_triangle = Slider(0, range=0..180)
all_triangles = Slider(0, range=0..180)

crv = Curve(<curve referenced from the Rhino model>)
srf = Surface(crv)

addition = Addition(A=right_triangle, B=all_triangles)
addition_2 = Addition(A=left_triangle, B=all_triangles)
addition_3 = Addition(A=top_triangle, B=all_triangles)
rad = Radians(Degrees=addition_3)
rad_2 = Radians(Degrees=addition)
rad_3 = Radians(Degrees=addition_2)
trigrid = Triangular(Plane=PlaneXY(0, 0, 0), Size=1, ExtentX=Slider(10, range=0..15), ExtentY=Slider(9, range=0..20))  # -> Cells, Points
bbox = BoundingBox(Content=flatten(trigrid.Cells), Plane=PlaneXY(0, 0, 0), UnionBox=True)  # -> Box, Box_2
disc = Discontinuity(Curve=trigrid.Cells, Level=1)  # -> Points, Parameters
srf_cp = SurfaceClosestPoint(Point=disc.Points, Surface=reparameterize(bbox.Box))  # -> Point, UVPoint, Distance
evalsrf = EvaluateSurface(Surface=reparameterize(srf), Point=srf_cp.UVPoint)  # -> Point, Normal, Frame
pt = Point(evalsrf.Point)
lng = ListLength(List=pt)
integer_division = IntegerDivision(A=lng, B=3)
series = Series(Start=0, Step=integer_division, Count=integer_division)  # -> expr("x-1", Series)
pline = PolyLine(Vertices=evalsrf.Point, Closed=Toggle(True))
item = ListItem(List=pt, Index=series, Wrap=True)  # -> Item, Item1, Item2
pt_2 = Point(item.Item1)
pt_3 = Point(item.Item)
pt_4 = Point(item.Item2)
centroid = Centroid(PointA=pt_3, PointB=pt_2, PointC=pt_4)  # -> Centroid, MedianAB, MedianBC, MedianCA
ln = Line(StartPoint=pt_3, EndPoint=pt_2)
ln_2 = Line(StartPoint=pt_2, EndPoint=pt_4)
ln_3 = Line(StartPoint=pt_4, EndPoint=pt_3)
addition_4 = Addition(A=pt_2, B=pt_4)
division = Division(A=addition_4, B=2)
addition_5 = Addition(A=pt_3, B=pt_2)
division_2 = Division(A=addition_5, B=2)
addition_6 = Addition(A=pt_3, B=pt_4)
division_3 = Division(A=addition_6, B=2)

# ----
# Right Triangle (Movable)
ln_4 = Line(StartPoint=pt_4, EndPoint=division_3)
ln_5 = Line(StartPoint=division_3, EndPoint=division)
ln_6 = Line(StartPoint=division, EndPoint=pt_4)
boundary = BoundarySurfaces(Edges=[ln_4, ln_5, ln_6])
rotax = RotateAxis(Geometry=boundary, Angle=rad_2, Axis=ln_5)  # -> Geometry, Transform

# ----
# Left Triangle (Movable)
ln_7 = Line(StartPoint=pt_2, EndPoint=division)
ln_8 = Line(StartPoint=division, EndPoint=division_2)
ln_9 = Line(StartPoint=division_2, EndPoint=pt_2)
boundary_2 = BoundarySurfaces(Edges=[ln_8, ln_7, ln_9])
rotax_2 = RotateAxis(Geometry=boundary_2, Angle=rad_3, Axis=ln_8)  # -> Geometry, Transform

# ----
# Top Triangle (Movable)
ln_10 = Line(StartPoint=pt_3, EndPoint=division_2)
ln_11 = Line(StartPoint=division_2, EndPoint=division_3)
ln_12 = Line(StartPoint=division_3, EndPoint=pt_3)
boundary_3 = BoundarySurfaces(Edges=[ln_10, ln_11, ln_12])
rotax_3 = RotateAxis(Geometry=boundary_3, Angle=rad, Axis=ln_11)  # -> Geometry, Transform

# ----
# Inner Triangle (static)
ln_13 = Line()
ln_14 = Line(StartPoint=division_2, EndPoint=division)
ln_15 = Line(StartPoint=division, EndPoint=division_3)
ln_16 = Line(StartPoint=division_3, EndPoint=division_2)
boundary_4 = BoundarySurfaces(Edges=[ln_14, ln_15, ln_16])

boundary_5 = BoundarySurfaces(Edges=pline)
