# Grasshopper definition Fin.gh (Grasshopper 1.0.7)

srf = Surface(<surface referenced from the Rhino model>)
rotation_angle_radians = Slider(0.3, range=0..0.5)
number_slider = Slider(18, range=0..100)
number_of_strips = Slider(10, range=0..100)
divide = DivideDomain²(Domain=srf, UCount=number_of_strips, VCount=Slider(1, range=0..1))
subsrf = Isotrim(Surface=srf, Domain=divide)
debrep = DeconstructBrep(Brep=subsrf)  # -> Faces, Edges, Vertices
item = ListItem(List=debrep.Edges, Index=0, Wrap=True)  # -> Item, Item1, Item2, Item3
stripthickness = Slider(0.7, range=0..1)
extrude_m = Slider(0.05, range=0.001..1)
crv = Curve(item.Item1)
crv_2 = Curve(item.Item3)
flip = FlipCurve(Curve=crv)  # -> Curve, Flag
divide_2 = DivideCurve(Curve=flip.Curve, Count=number_slider, Kinks=False)  # -> Points, Tangents, Parameters
divide_3 = DivideCurve(Curve=crv_2, Count=number_slider, Kinks=False)  # -> Points, Tangents, Parameters
neg = Negative(Value=rotation_angle_radians)
ln = Line(StartPoint=divide_2.Points, EndPoint=divide_3.Points)
curvepoint = PointOnCurve(ln, parameter=0.5)
scale = Scale(Geometry=ln, Center=curvepoint, Factor=stripthickness)  # -> Geometry, Transform
vec = Vector(Vector(0, 0.7065984225, 0))
loft = Loft(Curves=scale.Geometry, Options={Adjust=False, Closed=False, LoftEnds=0, LoftSimp=0, LoftType=0, Rebuild=10, Refit=0.01})
multiplication = Multiplication(A=vec, B=extrude_m)
extr = Extrude(Base=loft, Direction=multiplication)
pi = Pi(Factor=1)
volume = Volume(Geometry=extr)  # -> Volume, Centroid
multiplication_2 = Multiplication(A=pi, B=neg)
multiplication_3 = Multiplication(B=multiplication_2)
vec_2 = Vector(Vector(0, 0, 1))
rot3d = Rotate3D(Geometry=extr, Angle=multiplication_3, Center=volume.Centroid, Axis=vec_2)  # -> Geometry, Transform
