# Grasshopper definition Fritt1.gh (Grasshopper 1.0.7)

srf = Surface(<surface referenced from the Rhino model>)
number_of_columns = Slider(30, range=0..100)
extrude_distance_m = Slider(0.01, range=0..1)
circle_radius_m = Slider(0.01, range=0..0.05)
n = Slider(30, range=0..100)
divide = DivideDomain²(Domain=srf, UCount=n, VCount=Slider(1, range=0..1))
subsrf = Isotrim(Surface=srf, Domain=divide)
debrep = DeconstructBrep(Brep=subsrf)  # -> Faces, Edges, Vertices
item = ListItem(List=debrep.Edges, Index=0, Wrap=True)  # -> Item, Item1, Item2, Item3
crv = Curve(item.Item3)
crv_2 = Curve(item.Item1)
flip = FlipCurve(Curve=crv_2)  # -> Curve, Flag
divide_2 = DivideCurve(Curve=flip.Curve, Count=n, Kinks=False)  # -> Points, Tangents, Parameters
divide_3 = DivideCurve(Curve=crv, Count=n, Kinks=False)  # -> Points, Tangents, Parameters
ln = Line(StartPoint=divide_2.Points, EndPoint=divide_3.Points)
cir = Circle(Plane=ln, Radius=circle_radius_m)
rotate = Rotate(Geometry=cir, Angle=1.570796327, Plane=divide_2.Points)  # -> Geometry, Transform
vec = Vector(Vector(0, 1, 0))
boundary = BoundarySurfaces(Edges=rotate.Geometry)
multiplication = Multiplication(A=vec, B=extrude_distance_m)
extr = Extrude(Base=boundary, Direction=multiplication)
