# Grasshopper definition Lou2.gh (Grasshopper 1.0.7)

srf = Surface(<surface referenced from the Rhino model>)
number_slider = Slider(18, range=0..100)
stripthickness = Slider(0.4, range=0..1)
number_of_strips = Slider(14, range=0..100)
divide = DivideDomain²(Domain=srf, UCount=number_of_strips, VCount=Slider(1, range=0..1))
subsrf = Isotrim(Surface=srf, Domain=divide)
debrep = DeconstructBrep(Brep=subsrf)  # -> Faces, Edges, Vertices
item = ListItem(List=debrep.Edges, Index=0, Wrap=True)  # -> Item, Item1, Item2, Item3
crv = Curve(item.Item1)
crv_2 = Curve(item.Item3)
flip = FlipCurve(Curve=crv)  # -> Curve, Flag
divide_2 = DivideCurve(Curve=flip.Curve, Count=number_slider, Kinks=False)  # -> Points, Tangents, Parameters
divide_3 = DivideCurve(Curve=crv_2, Count=number_slider, Kinks=False)  # -> Points, Tangents, Parameters
ln = Line(StartPoint=divide_2.Points, EndPoint=divide_3.Points)
curvepoint = PointOnCurve(ln, parameter=0.5)
scale = Scale(Geometry=ln, Center=curvepoint, Factor=stripthickness)  # -> Geometry, Transform
loft = Loft(Curves=scale.Geometry, Options={Adjust=False, Closed=False, LoftEnds=0, LoftSimp=0, LoftType=0, Rebuild=10, Refit=0.01})
