# Grasshopper definition PlotSubjectData_Clustered.gh (Grasshopper 1.0.7)

subjects_augmentation = ValueList({"AR", "Desktop"}, selected="AR")

# ---- group: Run Simulation
writetofile_standing = BooleanToggle(False)
writetofile_viewing = BooleanToggle(False)
runsimulation = BooleanToggle(False)
bake = BooleanToggle(False)
and = GateAnd(A=runsimulation, B=bake)
and_2 = GateAnd(A=runsimulation, B=writetofile_viewing)
and_3 = GateAnd(A=runsimulation, B=writetofile_standing)

# ----
subject_performance_log_generated_by_r_s = Panel("C:\\Users\\jsermari\\Documents\\AR_Facades\\Data\\Subjects\\SubjectPerformance.csv")  # "Subject Performance Log (Generated by R Script)"
panel = Panel("C:\\Users\\jsermari\\Documents\\AR_Facades\\Data\\TestFiles")
# Subject's Data
panel_2 = Panel("C:\\Users\\jsermari\\Documents\\AR_Facades\\Data\\Subjects")
subject_type = ValueList({"All Subjects": "All", "High Performer": "High", "Low Performer": "Low", "High Gazer", "Low Gazer"}, selected="Low Performer")
# Facade Rankings File (Generated by R and Pareto)
panel_3 = Panel("C:\\Users\\jsermari\\Documents\\AR_Facades\\Data\Rankings\\\FacadeOptimalData.csv")
subjects_room = ValueList({"Conference", "Office"}, selected="Conference")
view_type = ValueList({"Head Rotation": 0, "Eye Gaze": 1}, selected="Eye Gaze")
# Heatmap - Facades To Use
# Heatmap - View Type
facades_to_use = ValueList({"None": 0, "Optimal": 1, "Poor": 2, "All": 3}, selected="All")
show_heatmaps = BooleanToggle(True)

# ---- group: Set for each room
# Reference Line (Facade bottom left)
# Floor Brep
# Window 1 Curve
# Window 2 Curve
experiment_reference_line = Line(Line((0.8644000002, 7.2262, 0.04440000016), (1.108212133, 7.2262, 0.04440000016)))
srf = Surface(<surface referenced from the Rhino model>)
crv = Curve([<curve referenced from the Rhino model> x28])
crv_2 = Curve([<curve referenced from the Rhino model> x22])

# ----
# Highlights
t = Slider(0.55, range=0..1)
show_highlight = BooleanToggle(False)

# ----
# Display Colors
head_pos_color = ColourSwatch(SwatchColor=RGB(245, 241, 5))
head_color_2 = ColourSwatch(SwatchColor=RGB(240, 38, 38))
head_color = ColourSwatch(SwatchColor=RGBA(196, 10, 10, 85))
eye_color_2 = ColourSwatch(SwatchColor=RGB(0, 148, 153))
floor_color = ColourSwatch(SwatchColor=RGB(255, 214, 48))
eye_color = ColourSwatch(SwatchColor=RGBA(79, 249, 255, 85))

# ----
# View Type
# Surface Type
list = ValueList({"None": 1, "Floor": 2, "Window 1": 3, "Window 2": 4, "Window 1/2": 5, "All": 6}, selected="All")
# Aesthetics
list_2 = ValueList({"None": 1, "Eye": 2, "Head": 3, "Line": 4, "Eye/Head": 5, "Eye/Line": 6, "Head/Line": 7, "All": 8}, selected="Line")  # disabled

brep = Brep()
debrep = DeconstructBrep(Brep=brep)  # -> Faces, Edges, Vertices
item = ListItem(List=debrep.Faces, Index=Slider(9, range=0..30), Wrap=True)

# ----
# Subject's Directory
# Single
# Subject
panel_4 = Panel("93")
panel_5 = Panel("36")

boundary = BoundarySurfaces(Edges=crv)
boundary_2 = BoundarySurfaces(Edges=crv_2)

# ----
# Multiple
# Subjects
generate_subjects_list = GhPythonScript(
    run=runsimulation,
    performance_filename=subject_performance_log_generated_by_r_s,
    room=subjects_room,
    augmentation=subjects_augmentation,
    subject_type=subject_type)  # -> out, subjects_list
# ---------- generate_subjects_list: Python ----------
__author__ = "jsermari"
__version__ = "2023.04.12"

import rhinoscriptsyntax as rs
import os
import csv

# Outputs
subjects_list = []


if run == True:
    # Open file
    assert os.path.isfile(performance_filename), "ERROR: File " + performance_filename + " not found."
    print("Opening " + performance_filename)
    # Read subject data
    with open(performance_filename) as csvfile:
        reader = csv.reader(csvfile, delimiter=",")
        for row in reader:
            if row[0] =="Participant.ID":
                continue
            row_augmentation = row[1]
            row_room = row[2]
            performance_type = "High" if row[4] == "TRUE" else "Low"
            gaze_type = "High Gazer" if row[11] == "High" else "Low Gazer"
            if subject_type == "All":
                if row_augmentation == augmentation and row_room == room:
                    subjects_list.append(row[0])
            elif subject_type == "High" or subject_type == "Low":
                if row_augmentation == augmentation and row_room == room and performance_type == subject_type:
                    subjects_list.append(row[0])
            else:
                #print(row[0])
                #print("1", row_augmentation == augmentation)
                #print("2", row_room == room)
                #print("3", gaze_type == subject_type)
                if row_augmentation == augmentation and row_room == room and gaze_type == subject_type:
                    #print("ay")
                    subjects_list.append(row[0])
        print(subjects_list)
        print(len(subjects_list))
    #subjects_list = [subjects_list[0]]
    #subjects_list = subjects_list[0:4]
    #subjects_list = ["62", "36"]
    #subjects_list = ["62"]
# ---------- end generate_subjects_list ----------

log = Panel(generate_subjects_list.out)
concat = Concatenate(FragmentA=panel_2, FragmentB="\\", FragmentC=panel_4, FragmentD="\\")
end = EndPoints(Curve=experiment_reference_line)  # -> Start, End
vec2pt = Vector2Pt(PointA=end.Start, PointB=end.End, Unitize=Toggle(True))  # -> Vector, Length
get_head_data = GhPythonScript(run=runsimulation, data_dir=concat, subject=panel_4)  # -> out, head_positions, head_rotations, facade_position, facade_rotation, gaze_positions, gaze_rotations, gaze_valids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
# ---------- get_head_data: Python ----------
__author__ = "John"
__version__ = "2023.01.18"

import rhinoscriptsyntax as rs
import Rhino
import csv
import os
from datetime import datetime
import math

datetime_format = '%H:%M:%S.%f'
"""
[
((pos_x,pos_y,pos_z), (rot_x,rot_y,rot_z), (gaze_pos_x, gaze_pos_y, gaze_pos_z), (gaze_rot_x, gaze_rot_y, gaze_rot_z), datetime, should_draw),
((pos_x,pos_y,pos_z), (rot_x,rot_y,rot_z), (gaze_pos_x, gaze_pos_y, gaze_pos_z), (gaze_rot_x, gaze_rot_y, gaze_rot_z), datetime, should_draw),
...
]
"""
# Input values
#head_data = []
#points = []
#head_rotations = []
# Output values
head_positions = []
head_rotations = []
#facade_position = None
#facade_rotation = None
facade_position = []
facade_rotation = []
gaze_positions = []
gaze_rotations = []
gaze_valids = []
timestamps = []
current_facades = []
facade_list = []
facade_timestamps = []
n = 0
# Script values
rs.scriptcontext.doc = rs.Rhino.RhinoDoc.ActiveDoc
experiment_start_timestamp = None
# Column numbers for data files
COL_DATA_TYPE = 0
COL_TIME_CURRENT = 1
COL_TIMESTAMP = 2
COL_FACADE = 3
COL_HEAD_POS_X = 10
COL_HEAD_POS_Y = 11
COL_HEAD_POS_Z = 12
COL_HEAD_ROT_X = 13
COL_HEAD_ROT_Y = 14
COL_HEAD_ROT_Z = 15
COL_FACADE_POS_X = 16
COL_FACADE_POS_Y = 17
COL_FACADE_POS_Z = 18
COL_FACADE_ROT_X = 19
COL_FACADE_ROT_Y = 20
COL_FACADE_ROT_Z = 21
COL_GAZE_VALID = 22
COL_GAZE_POS_X = 23
COL_GAZE_POS_Y = 24
COL_GAZE_POS_Z = 25
COL_GAZE_ROT_X = 26
COL_GAZE_ROT_Y = 27
COL_GAZE_ROT_Z = 28
# Conversion ratio
conversion_factor = 0.01 # cm to m


def read_timestamp(cell_value):
    data = cell_value.strip()
    # Data
    date = data.split("-")[0]
    month = int(date.split("_")[1])
    day = int(date.split("_")[2])
    year = int(date.split("_")[0])
    # Time
    time = data.split("-")[1]
    hour = int(time.split(":")[0])
    minute = int(time.split(":")[1])
    second = int(time.split(":")[2].split(".")[0])
    millisecond = int(time.split(":")[2].split(".")[1])
    microsecond = millisecond * 1000
    
    return datetime(year, month, day, hour, minute, second, microsecond)

"""
def tranform_according_to_ref(x, y, z, ref_point, facade_pos):
    x_ref = ref_point[0]
    y_ref = ref_point[1]
    z_ref = ref_point[2]
    facade_x = facade_pos[0]
    facade_y = facade_pos[1]
    facade_z = facade_pos[2]
    # TODO
    return x, y, z
"""

##### MAIN #####
# Get subject data file
if run == True:
    print(subject)
    subject_data_file = data_dir + "\\" + subject + ".csv"
    assert os.path.isfile(subject_data_file), "ERROR: File " + subject_data_file + " not found."
    print("Opening " + subject_data_file)
    """
    # Get facade position by reading last row in csv
    with open(subject_data_file) as csvfile:
        reader = csv.reader(csvfile, delimiter=",")
        i = 0 # May need for later
        for row in reader:
            if i == 0:
                i = i + 1
                continue
            if row[COL_FACADE_POS_X] != "":
                # Clear old values if necessary to reduce memory usage
                if facade_position != None:
                    del facade_position[:]
                if facade_rotation != None:
                    del facade_rotation[:]
                # Assign new values
                facade_position = [ \
                float(row[COL_FACADE_POS_X]),
                float(row[COL_FACADE_POS_Y]),
                float(row[COL_FACADE_POS_Z])]
                facade_rotation = [ \
                float(row[COL_FACADE_ROT_X]),
                float(row[COL_FACADE_ROT_Y]),
                float(row[COL_FACADE_ROT_Z])]
            i = i + 1
    """
    # Read subject data
    with open(subject_data_file) as csvfile:
        reader = csv.reader(csvfile, delimiter=",")
        for row in reader:
            type = row[COL_DATA_TYPE]
            if type=="GUI_Test_Complete":
                experiment_start_timestamp = read_timestamp(row[COL_TIMESTAMP])
                facade_list.append("fin_20_30") # Hardcoded as first
                facade_timestamps.append(experiment_start_timestamp)
            elif type == "Head":
                ## Determine if experiment had started
                if experiment_start_timestamp == None: #or timestamp <= experiment_start_timestamp:
                    continue
                # Count
                n = n + 1
                ## Timestamp
                timestamp = read_timestamp(row[COL_TIMESTAMP])
                timestamps.append(timestamp)
                ## Head position
                head_pos_x = float(row[COL_HEAD_POS_X]) * conversion_factor
                head_pos_y = float(row[COL_HEAD_POS_Y]) * conversion_factor
                head_pos_z = float(row[COL_HEAD_POS_Z]) * conversion_factor
                # Swap y and z to convert from left handed (unreal) to right handed (rhino) coordinate system
                head_positions.append(Rhino.Geometry.Point3d(head_pos_x, head_pos_z, head_pos_y))
                ## Head rotation
                head_rot_x = float(row[COL_HEAD_ROT_X])
                head_rot_y = float(row[COL_HEAD_ROT_Y])
                head_rot_z = float(row[COL_HEAD_ROT_Z])
                # Swap y and z to convert from left handed (unreal) to right handed (rhino) coordinate system
                head_rotations.append(Rhino.Geometry.Point3d(head_rot_x, head_rot_z, head_rot_y))
                ## Facade position
                facade_pos_x = float(row[COL_FACADE_POS_X]) * conversion_factor
                facade_pos_y = float(row[COL_FACADE_POS_Y]) * conversion_factor
                facade_pos_z = float(row[COL_FACADE_POS_Z]) * conversion_factor
                # Swap y and z to convert from left handed (unreal) to right handed (rhino) coordinate system
                #facade_position = Rhino.Geometry.Point3d(facade_pos_x, facade_pos_z, facade_pos_y) # Will always be overwritten
                facade_position.append(Rhino.Geometry.Point3d(facade_pos_x, facade_pos_z, facade_pos_y))
                ## Facade rotation
                facade_rot_x = float(row[COL_FACADE_ROT_X])
                facade_rot_y = float(row[COL_FACADE_ROT_Y])
                facade_rot_z = float(row[COL_FACADE_ROT_Z])
                # Swap y and z to convert from left handed (unreal) to right handed (rhino) coordinate system
                #facade_rotation = Rhino.Geometry.Point3d(facade_rot_x, facade_rot_z, facade_rot_y) # Will always be overwritten
                facade_rotation.append(Rhino.Geometry.Point3d(facade_rot_x, facade_rot_z, facade_rot_y))
                ## Gaze position
                gaze_pos_x = float(row[COL_GAZE_POS_X]) * conversion_factor
                gaze_pos_y = float(row[COL_GAZE_POS_Y]) * conversion_factor
                gaze_pos_z = float(row[COL_GAZE_POS_Z]) * conversion_factor
                # Swap y and z to convert from left handed (unreal) to right handed (rhino) coordinate system
                gaze_positions.append(Rhino.Geometry.Point3d(gaze_pos_x, gaze_pos_z, gaze_pos_y))
                ## Gaze rotation
                gaze_rot_x = float(row[COL_GAZE_ROT_X])
                gaze_rot_y = float(row[COL_GAZE_ROT_Y])
                gaze_rot_z = float(row[COL_GAZE_ROT_Z])
                # Swap y and z to convert from left handed (unreal) to right handed (rhino) coordinate system
                gaze_rotations.append(Rhino.Geometry.Point3d(gaze_rot_x, gaze_rot_z, gaze_rot_y))
                ## Gaze visible
                gaze_valids.append((row[COL_GAZE_VALID].upper().strip() == "TRUE"))
                ## Currently active facade
                current_facades.append(facade_list[len(facade_list) - 1])
            elif type == "Settings_Changed":
                facade_list.append(row[COL_FACADE])
                facade_timestamps.append(read_timestamp(row[COL_TIMESTAMP]))
    
    """
    for i in range(0, len(head_data) - 1):
        #Rhino.Geometry.Point3d(
        points.append(Rhino.Geometry.Point3d(head_data[i][0][0], head_data[i][0][1], head_data[i][0][2]))
        head_rotations.append(Rhino.Geometry.Point3d(head_data[i][1][0], head_data[i][1][1], head_data[i][1][2]))
    """
# ---------- end get_head_data ----------
facades_data = GhPythonScript(rankings_filename=panel_3, current_room=subjects_room, facades=get_head_data.current_facades)  # -> out, is_optimal, rank; inputs facades: list
# ---------- facades_data: Python ----------
__author__ = "John"
__version__ = "2023.04.11"

import rhinoscriptsyntax as rs
import csv
import os


# Column numbers for data files
COL_FACADE = 0
COL_ROOM = 1
COL_ISOPTIMAL = 6
COL_RANK = 7
# Outputs
is_optimal = []
rank = []

# Create dict so CSV only needs to be opened once
facades_dict = {}
assert os.path.isfile(rankings_filename), "ERROR: File " + rankings_filename + " not found."
print("Opening " + rankings_filename)
with open(rankings_filename) as csvfile:
    reader = csv.reader(csvfile, delimiter=",")
    for row in reader:
        facades_dict[(row[COL_ROOM].upper(), row[COL_FACADE].upper())] = (row[COL_ISOPTIMAL], row[COL_RANK])
        #print(facades_dict)
# Search thru dict to match up values
for facade in facades:
    # Fix potential issues with rhino/R naming of facades
    if "facade1" in facade:
        facade = facade.replace("facade1", "dynamic")
    if "louver_hor" in facade:
        facade = facade.replace("louver_hor", "louver")
    if "10_75" in facade:
        facade = facade.replace("10_75", "10_70")
    if "20_75" in facade:
        facade = facade.replace("20_75", "20_70")
    # Generate output list values
    #print((current_room.upper(), facade.upper()))
    opt = facades_dict[(current_room.upper(), facade.upper())][0]
    opt = opt == "1"
    is_optimal.append(opt)
    r = int(facades_dict[(current_room.upper(), facade.upper())][1])
    rank.append(r)
# ---------- end facades_data ----------
vdis = VectorDisplay(Anchor=end.Start, Vector=vec2pt.Vector)
facades_cull_pattern = GhPythonScript(is_optimal=facades_data.is_optimal, picker=facades_to_use)  # -> out, cull_pattern; inputs is_optimal: list
# ---------- facades_cull_pattern: Python ----------
__author__ = "jsermari"
__version__ = "2023.04.11"

import rhinoscriptsyntax as rs

cull_pattern = []

for i in range(0, len(is_optimal)):
    if picker == 0:
        cull_pattern.append(False)
    elif picker == 1:
        cull_pattern.append(is_optimal[i])
    elif picker == 2:
        cull_pattern.append(not is_optimal[i])
    elif picker == 3:
        cull_pattern.append(True)
# ---------- end facades_cull_pattern ----------
panel_6 = Panel(get_head_data.out)

# ----
# Highlight list index
# Data start
# Custom start
# End
# Custom end
panel_7 = Panel("Highlight (Range)")
lng = ListLength(List=get_head_data.timestamps)
panel_8 = Panel("End")
panel_9 = Panel("Start")
millisecond = Slider(0, range=0..999)
millisecond_2 = Slider(230, range=0..999)
second = Slider(0, range=0..59)
second_2 = Slider(0, range=0..59)
month = Slider(3, range=1..12)
minute = Slider(30, range=0..59)
month_2 = Slider(3, range=1..12)
minute_2 = Slider(0, range=0..59)
year = Slider(2022, range=2021..2023)
day = Slider(7, range=1..31)
year_2 = Slider(2022, range=2021..2023)
day_2 = Slider(7, range=1..31)
hour = Slider(18, range=0..23)
hour_2 = Slider(18, range=0..23)
subtraction = Subtraction(A=lng, B="1")
readtimestamp = GhPythonScript(timestamp_str=get_head_data.timestamps)  # -> out, year, month, day, hour, minute, second, microsecond; disabled
# ---------- readtimestamp: Python ----------
__author__ = "jsermari"
__version__ = "2023.02.06"

import rhinoscriptsyntax as rs
from datetime import datetime

timestamp = None

has_microsecond = "." in timestamp_str
if has_microsecond:
    timestamp = datetime.strptime(timestamp_str, '%Y-%m-%d %H:%M:%S.%f')
else:
    timestamp = datetime.strptime(timestamp_str, '%Y-%m-%d %H:%M:%S')
print(timestamp)

year = timestamp.year
month = timestamp.month
day = timestamp.day
hour = timestamp.hour
minute = timestamp.minute
second = timestamp.second
if has_microsecond:
    microsecond = timestamp.microsecond
else:
    microsecond = 0
# ---------- end readtimestamp ----------
item_2 = ListItem(List=get_head_data.timestamps, Index=subtraction, Wrap=True)
item_3 = ListItem(List=get_head_data.timestamps, Index="0", Wrap=True)
panel_10 = Panel(item_2)
panel_11 = Panel(item_3)
multiplication = Multiplication(A=millisecond, B="1000")
multiplication_2 = Multiplication(A=millisecond_2, B="1000")
createtimestamp = GhPythonScript(year=year, month=month, day=day, hour=hour, minute=minute, second=second, microsecond=multiplication)  # -> out, timestamp; inputs year: Int32, month: Int32, day: Int32, hour: Int32, minute: Int32, second: Int32, microsecond: Int32
# ---------- createtimestamp: Python ----------
__author__ = "jsermari"
__version__ = "2023.02.06"

import rhinoscriptsyntax as rs
from datetime import datetime

timestamp = datetime(year, month, day, hour, minute, second, microsecond)
# ---------- end createtimestamp ----------
createtimestamp_2 = GhPythonScript(year=year_2, month=month_2, day=day_2, hour=hour_2, minute=minute_2, second=second_2, microsecond=multiplication_2)  # -> out, timestamp; inputs year: Int32, month: Int32, day: Int32, hour: Int32, minute: Int32, second: Int32, microsecond: Int32; same code as createtimestamp
timestampculling = GhPythonScript(timestamps_all=get_head_data.timestamps, start=createtimestamp_2.timestamp, end=createtimestamp.timestamp)  # -> out, in_range; inputs timestamps_all: list
# ---------- timestampculling: Python ----------
__author__ = "jsermari"
__version__ = "2023.02.06"

import rhinoscriptsyntax as rs
from datetime import datetime

## Read timestamps
# START
has_microsecond = "." in start
if has_microsecond:
    start_timestamp = datetime.strptime(start, '%Y-%m-%d %H:%M:%S.%f')
else:
    start_timestamp = datetime.strptime(start, '%Y-%m-%d %H:%M:%S')
# END
has_microsecond = "." in end
if has_microsecond:
    end_timestamp = datetime.strptime(end, '%Y-%m-%d %H:%M:%S.%f')
else:
    end_timestamp = datetime.strptime(end, '%Y-%m-%d %H:%M:%S')

print("TIME START", start_timestamp)
print("TIME END", end_timestamp)

in_range = []
for i in range(0, len(timestamps_all)):
    t = timestamps_all[i]
    has_microsecond = "." in t
    if has_microsecond:
        t_timestamp = datetime.strptime(t, '%Y-%m-%d %H:%M:%S.%f')
    else:
        t_timestamp = datetime.strptime(t, '%Y-%m-%d %H:%M:%S')
        
    if(i == 0):
        print("CURRENT", t_timestamp)
    
    after_start = t_timestamp > start_timestamp
    before_end = t_timestamp < end_timestamp
    print("AFTER:", after_start)
    print("BEFORE:", before_end)
    if after_start and before_end:
        in_range.append(True)
    else:
        in_range.append(False)
# ---------- end timestampculling ----------
cull = CullPattern(List=get_head_data.timestamps, CullPattern=timestampculling.in_range)
createtimestamp_3 = GhPythonScript(
    year=readtimestamp.year,
    month=readtimestamp.month,
    day=readtimestamp.day,
    hour=readtimestamp.hour,
    minute=readtimestamp.minute,
    second=readtimestamp.second,
    microsecond=readtimestamp.microsecond)  # -> out, timestamp; same code as createtimestamp
panel_12 = Panel("Highlight (Single moment)")
lng_2 = ListLength(List=get_head_data.timestamps)
subtraction_2 = Subtraction(A=lng_2, B="1")
multiplication_3 = Multiplication(A=t, B=subtraction_2)
round = Round(Number=multiplication_3)  # -> Nearest, Floor, Ceiling
item_4 = ListItem(List=get_head_data.timestamps, Index=round.Nearest, Wrap=True)
getcurrentfacade = GhPythonScript(facade_list=get_head_data.facade_list, facade_timestamps=get_head_data.facade_timestamps, timestamp_current=item_4)  # -> out, facade_surface1, facade_surface2, facade_name, switched_time; inputs facade_list: list, facade_timestamps: list
# ---------- getcurrentfacade: Python ----------
__author__ = "jsermari"
__version__ = "2023.02.07"

import rhinoscriptsyntax as rs
from datetime import datetime

rs.scriptcontext.doc = rs.Rhino.RhinoDoc.ActiveDoc

def get_surfaces(facade_name):
    #print(rs.LayerChildren("facades::Pos1"))
    #rs.LayerId()
    
    facade_pos1 = None
    layer_name = "facades::Pos1" + "::" + facade_name
    facade_pos1 = rs.ObjectsByLayer(layer_name)
    #print(rs.ObjectsByLayer(layer_name))
    
    facade_pos2 = None
    if(rs.IsLayer("facades::Pos2")):
        layer_name = "facades::Pos2" + "::" + facade_name
        facade_pos2 = rs.ObjectsByLayer(layer_name)
    return facade_pos1, facade_pos2

has_microsecond = "." in timestamp_current
if has_microsecond:
    timestamp = datetime.strptime(timestamp_current, '%Y-%m-%d %H:%M:%S.%f')
else:
    timestamp = datetime.strptime(timestamp_current, '%Y-%m-%d %H:%M:%S')

facade_surface = None
facade_name = None
switched_time = None

# Find most recent active facade
for i in range(0, len(facade_list)):
    facade = facade_list[i]
    f_timestamp_str = facade_timestamps[i]
    
    has_microsecond = "." in f_timestamp_str
    if has_microsecond:
        f_timestamp = datetime.strptime(f_timestamp_str, '%Y-%m-%d %H:%M:%S.%f')
    else:
        f_timestamp = datetime.strptime(f_timestamp_str, '%Y-%m-%d %H:%M:%S')
    # Exit if needed
    if f_timestamp > timestamp:
        break
    # Update values
    facade_surfaces = get_surfaces(facade)
    facade_surface1 = facade_surfaces[0]
    facade_surface2 = facade_surfaces[1]
    facade_name = facade
    switched_time = f_timestamp
# ---------- end getcurrentfacade ----------
brep_2 = Brep(getcurrentfacade.facade_surface1)
brep_3 = Brep(getcurrentfacade.facade_surface2)
showif = GhPythonScript(show=show_highlight, geom=flatten([brep_3, brep_2]))  # -> out, out_geom
# ---------- showif: Python ----------
__author__ = "jsermari"
__version__ = "2023.02.07"

import rhinoscriptsyntax as rs

out_geom = None
if show:
    out_geom = geom
# ---------- end showif ----------
material = CreateMaterial(
    Diffuse=ColourSwatch(SwatchColor=RGB(208, 87, 235)),
    Specular=RGB(255, 255, 255),
    Emission=RGB(0, 0, 0),
    Transparency=Slider(0.662, range=0..1),
    Shine=0)
preview = CustomPreview(Geometry=showif.out_geom, Material=material)

# ----
# HEAD ROTATIONS (Unreal coordinates)
panel_13 = Panel("Create Head Rotations")
pdecon = Deconstruct(Point=get_head_data.head_rotations)  # -> XComponent, YComponent, ZComponent
eulertovec = EulerToVec(x=pdecon.XComponent, y=pdecon.YComponent, z=pdecon.ZComponent)  # -> out, vector
# ---------- eulertovec: Python ----------
__author__ = "John"
__version__ = "2023.01.23"

import rhinoscriptsyntax as rs
import Rhino
import math

# Output values
vector = None

## Convert degrees to radians
"""
pitch = math.radians(pitch)
yaw = math.radians(yaw)
roll = math.radians(roll)
"""
pitch = math.radians(z)
yaw = math.radians(y)
roll = math.radians(x)
## Convert from pitch/yaw/roll to vector
# https://stackoverflow.com/questions/1568568/how-to-convert-euler-angles-to-directional-vector

x_vec = math.cos(yaw) * math.cos(pitch)
y_vec = math.sin(yaw) * math.cos(pitch)
z_vec = math.sin(pitch)
"""
x = -math.cos(yaw) * math.sin(pitch) * math.sin(roll) - math.sin(yaw) * math.cos(roll)
y = -math.sin(yaw) * math.sin(pitch) * math.sin(roll) + math.cos(yaw) * math.cos(roll)
z =  math.cos(pitch) * math.sin(roll)
"""
vector = Rhino.Geometry.Point3d(x_vec, y_vec, z_vec)
# ---------- end eulertovec ----------

# ----
# GAZE ROTATIONS (Unreal coordinates)
panel_14 = Panel("Create Gaze Rotations")

# ----
# PATH (Unreal coordinates)
panel_15 = Panel("Create Head path")
cull_i = CullIndex(List=get_head_data.head_positions, Indices="-1", Wrap=True)
shift = ShiftList(List=get_head_data.head_positions, Shift="1", Wrap=Toggle(False))
ln = Line(StartPoint=cull_i, EndPoint=shift)

# ----
# Convert from Unreal to Rhino Coordinates (Position)
# Convert from Euler to Vector
pdecon_2 = Deconstruct(Point=get_head_data.facade_rotation)  # -> XComponent, YComponent, ZComponent
python = GhPythonScript(pitch=pdecon_2.ZComponent, yaw=pdecon_2.YComponent, roll=pdecon_2.XComponent)  # -> out, vector
# ---------- python: Python ----------
__author__ = "John"
__version__ = "2023.01.23"

import rhinoscriptsyntax as rs
import Rhino
import math

# Output values
vector = None

## Convert degrees to radians
pitch = math.radians(pitch)
yaw = math.radians(yaw)
roll = math.radians(roll)
## Convert from pitch/yaw/roll to vector
# https://stackoverflow.com/questions/1568568/how-to-convert-euler-angles-to-directional-vector

x = math.cos(yaw) * math.cos(pitch)
y = math.sin(yaw) * math.cos(pitch)
z = math.sin(pitch)
"""
x = -math.cos(yaw) * math.sin(pitch) * math.sin(roll) - math.sin(yaw) * math.cos(roll)
y = -math.sin(yaw) * math.sin(pitch) * math.sin(roll) + math.cos(yaw) * math.cos(roll)
z =  math.cos(pitch) * math.sin(roll)
"""
vector = Rhino.Geometry.Point3d(x, y, z)
# ---------- end python ----------
eulertovec_2 = EulerToVec(x=pdecon_2.XComponent, y=pdecon_2.YComponent, z=pdecon_2.ZComponent)  # -> out, vector; same code as eulertovec
vdis_2 = VectorDisplay(Anchor=get_head_data.facade_position, Vector=eulertovec_2.vector)
panel_16 = Panel("Create rotational vector")
pdecon_3 = Deconstruct(Point=eulertovec_2.vector)  # -> XComponent, YComponent, ZComponent
vec = VectorXYZ(XComponent=pdecon_3.XComponent, YComponent=pdecon_3.YComponent, ZComponent=pdecon_3.ZComponent)  # -> Vector, Length
unit = UnitVector(Vector=vec.Vector)
vdis_3 = VectorDisplay(Anchor=end.Start, Vector=unit)
panel_17 = Panel("Translate")
vec2pt_2 = Vector2Pt(PointA=get_head_data.facade_position, PointB=end.Start, Unitize=False)  # -> Vector, Length
move = Move(Geometry=ln, Motion=vec2pt_2.Vector)  # -> Geometry, Transform
# Convert from Unreal to Rhino Coordinates (Rotation)
# ORDER:
# 1. XY Plane
# 2. XZ Plane
# 3. YZ Plane
pl = PlaneNormal(Origin=end.Start, ZAxis=unit)
pl_2 = PlaneNormal(Origin=end.Start, ZAxis=vec2pt.Vector)
deplane = DeconstructPlane(Plane=pl)  # -> Origin, XAxis, YAxis, ZAxis
# Reference Vectors
deplane_2 = DeconstructPlane(Plane=pl_2)  # -> Origin, XAxis, YAxis, ZAxis
neg = Negative(Value=deplane_2.XAxis)
swatch = ColourSwatch(SwatchColor=RGB(255, 36, 36))
number_slider = Slider(1, range=1..5)
# Unreal Data
swatch_2 = ColourSwatch(SwatchColor=RGB(36, 167, 255))
number_slider_2 = Slider(1, range=1..5)
neg_2 = Negative(Value=deplane_2.YAxis)
line = LineSDL(Start=deplane.Origin, Direction=deplane.XAxis, Length=1)
line_2 = LineSDL(Start=deplane.Origin, Direction=deplane.YAxis, Length=1)
line_3 = LineSDL(Start=deplane.Origin, Direction=deplane.ZAxis, Length=1)
vdisex = VectorDisplayEx(Point=deplane_2.Origin, Vector=deplane_2.ZAxis, Colour=swatch, Width=number_slider)
vdisex_2 = VectorDisplayEx(Point=deplane_2.Origin, Vector=deplane_2.XAxis, Colour=swatch, Width=number_slider)
vdisex_3 = VectorDisplayEx(Point=deplane_2.Origin, Vector=deplane_2.YAxis, Colour=swatch, Width=number_slider)
vdisex_4 = VectorDisplayEx(Point=deplane.Origin, Vector=deplane.XAxis, Colour=swatch_2, Width=number_slider_2)
vdisex_5 = VectorDisplayEx(Point=deplane.Origin, Vector=deplane.YAxis, Colour=swatch_2, Width=number_slider_2)
vdisex_6 = VectorDisplayEx(Point=deplane.Origin, Vector=deplane.ZAxis, Colour=swatch_2, Width=number_slider_2)
_0 = Number(0)
_1 = Number(1)
vec_2 = VectorXYZ(XComponent=_1, YComponent=_0, ZComponent=_0)  # -> Vector, Length
vec_3 = VectorXYZ(XComponent=_0, YComponent=_1, ZComponent=_0)  # -> Vector, Length
vec_4 = VectorXYZ(XComponent=_1, YComponent=_0, ZComponent=_0)  # -> Vector, Length
vec_5 = VectorXYZ(XComponent=_0, YComponent=_0, ZComponent=_1)  # -> Vector, Length
vec_6 = VectorXYZ(XComponent=_0, YComponent=_1, ZComponent=_0)  # -> Vector, Length
vec_7 = VectorXYZ(XComponent=_0, YComponent=_0, ZComponent=_1)  # -> Vector, Length
# XY
pl_3 = ConstructPlane(Origin=end.Start, XAxis=vec_2.Vector, YAxis=vec_3.Vector)
# XZ
pl_4 = ConstructPlane(Origin=end.Start, XAxis=vec_4.Vector, YAxis=vec_5.Vector)
# YZ
pl_5 = ConstructPlane(Origin=end.Start, XAxis=vec_6.Vector, YAxis=vec_7.Vector)
angle = Angle(VectorA=deplane.XAxis, VectorB=deplane_2.XAxis, Plane=pl_5)  # -> Angle, Reflex
min = Minimum(A=angle.Angle, B=angle.Reflex)
number_slider_3 = Slider(0, range=0..360)
number_slider_4 = Slider(91.534, range=0..360)
number_slider_5 = Slider(167.222, range=0..360)
rad = Radians(Degrees=Slider(91.481, range=0..360))
rad_2 = Radians(Degrees=Slider(95.586, range=0..360))
rad_3 = Radians(Degrees=Slider(0, range=0..360))
# Alignment Vectors
vrot = Rotate(Vector=deplane.XAxis, Axis=deplane_2.ZAxis, Angle=min)
head_rot = Rotate(Vector=eulertovec.vector, Axis=deplane_2.ZAxis, Angle=min)
gaze_rot = Rotate(Vector=get_head_data.gaze_rotations, Axis=deplane_2.ZAxis, Angle=min)
head_pos = Rotate3D(Geometry=move.Geometry, Angle=min, Center=end.Start, Axis=deplane_2.ZAxis)  # -> Geometry, Transform
vrot_2 = Rotate(Vector=deplane.YAxis, Axis=deplane_2.ZAxis, Angle=min)
vrot_3 = Rotate(Vector=deplane.ZAxis, Axis=deplane_2.ZAxis, Angle=min)
angle_2 = Angle(VectorA=vrot_3, VectorB=deplane_2.ZAxis, Plane=pl_3)  # -> Angle, Reflex
max = Maximum(A=angle_2.Angle, B=angle_2.Reflex)
# Alignment Vectors
vrot_4 = Rotate(Vector=vrot, Axis=deplane_2.YAxis, Angle=angle_2.Angle)
head_pos_2 = Rotate3D(Geometry=head_pos.Geometry, Angle=angle_2.Angle, Center=end.Start, Axis=deplane_2.YAxis)  # -> Geometry, Transform
head_rot_2 = Rotate(Vector=head_rot, Axis=deplane_2.YAxis, Angle=angle_2.Angle)
gaze_rot_2 = Rotate(Vector=gaze_rot, Axis=deplane_2.YAxis, Angle=angle_2.Angle)
vrot_5 = Rotate(Vector=vrot_2, Axis=deplane_2.YAxis, Angle=angle_2.Angle)
vrot_6 = Rotate(Vector=vrot_3, Axis=deplane_2.YAxis, Angle=angle_2.Angle)
angle_3 = Angle(VectorA=vrot_6, VectorB=deplane_2.ZAxis, Plane=pl_4)  # -> Angle, Reflex
deg = Degrees(Radians=angle_3.Reflex)
deg_2 = Degrees(Radians=angle_3.Angle)
max_2 = Maximum(A=angle_3.Angle, B=angle_3.Reflex)
# Alignment Vectors
vrot_7 = Rotate(Vector=vrot_4, Axis=deplane_2.XAxis, Angle=max_2)
head_rot_3 = Rotate(Vector=head_rot_2, Axis=deplane_2.XAxis, Angle=max_2)
gaze_rot_3 = Rotate(Vector=gaze_rot_2, Axis=deplane_2.XAxis, Angle=max_2)
head_pos_3 = Rotate3D(Geometry=head_pos_2.Geometry, Angle=max_2, Center=end.Start, Axis=deplane_2.XAxis)  # -> Geometry, Transform
vrot_8 = Rotate(Vector=vrot_5, Axis=deplane_2.XAxis, Angle=max_2)
vrot_9 = Rotate(Vector=vrot_6, Axis=deplane_2.XAxis, Angle=max_2)
vdis_4 = VectorDisplay(Anchor=end.Start, Vector=vrot)
vdis_5 = VectorDisplay(Anchor=end.Start, Vector=vrot_2)
vdis_6 = VectorDisplay(Anchor=end.Start, Vector=vrot_3)
vdis_7 = VectorDisplay(Anchor=end.Start, Vector=vrot_4)
vdis_8 = VectorDisplay(Anchor=end.Start, Vector=vrot_7)
vdis_9 = VectorDisplay(Anchor=end.Start, Vector=vrot_5)
vdis_10 = VectorDisplay(Anchor=end.Start, Vector=vrot_8)
vdis_11 = VectorDisplay(Anchor=end.Start, Vector=vrot_6)
vdis_12 = VectorDisplay(Anchor=end.Start, Vector=vrot_9)

# ---- group: Conference Room
# Apply position offsets to account for Unreal nudges
panel_18 = Panel("CONF:")
X = Slider(0.5, range=-200..200)
Y = Slider(0, range=-200..200)
Z = Slider(0.5, range=-200..200)
pt = ConstructPoint(XCoordinate=X, YCoordinate=Y, ZCoordinate=Z)

# ---- group: Office
X_2 = Slider(0.4, range=-200..200)
Y_2 = Slider(-0.5, range=-200..200)
Z_2 = Slider(1, range=-200..200)
panel_19 = Panel("OFFICE:")
pt_2 = ConstructPoint(XCoordinate=X_2, YCoordinate=Y_2, ZCoordinate=Z_2)

# ----
pt_3 = ConstructPoint(XCoordinate="0", YCoordinate="0", ZCoordinate="0")

# ---- group: Desktop
X_3 = Slider(0, range=-200..200)
Y_3 = Slider(0, range=-200..200)
Z_3 = Slider(0, range=-200..200)
panel_20 = Panel("DESKTOP:")
pt_4 = ConstructPoint(XCoordinate=X_3, YCoordinate=Y_3, ZCoordinate=Z_3)

# ----
vec2pt_3 = Vector2Pt(PointA=pt_3, PointB=pt, Unitize=False)  # -> Vector, Length
move_2 = Move(Geometry=head_pos_3.Geometry, Motion=vec2pt_3.Vector)  # -> Head_points, Transform
panel_21 = Panel("Room-specific adjustments")

# ---- group: Office - AR
rad_4 = Radians(Degrees=Slider(270, range=0..360))
head_rot_4 = Rotate(Vector=head_rot_3, Axis=deplane_2.YAxis, Angle=rad_4)
gaze_rot_4 = Rotate(Vector=gaze_rot_3, Axis=deplane_2.YAxis, Angle=rad_4)
head_pos_4 = Rotate3D(Geometry=move_2.Head_points, Angle=rad_4, Center=end.Start, Axis=deplane_2.YAxis)  # -> Geometry, Transform

# ---- group: Conference - Desktop (TODO)
rad_5 = Radians(Degrees=Slider(90, range=0..360))
head_pos_5 = Rotate3D(Geometry=move_2.Head_points, Angle=rad_5, Center=end.Start, Axis=deplane_2.ZAxis)  # -> Geometry, Transform

# ----
# HEAD POS LINE
# HEAD ROT
# EYE ROT
end_2 = EndPoints(Curve=move_2.Head_points)  # -> Start, End
lng_3 = ListLength(List=end_2.End)
subtraction_3 = Subtraction(A=lng_3, B="1")
display_filter_surface = GhPythonScript(surface_type=list, floor=srf, window1=boundary, window2=boundary_2)  # -> out, out_floor, out_window1, out_window2
# ---------- display_filter_surface: Python ----------
__author__ = "jsermari"
__version__ = "2023.02.03"

import rhinoscriptsyntax as rs
import Rhino

out_floor = None
out_window1 = None
out_window2 = None

if surface_type == 1:
    pass
elif surface_type == 2:
    out_floor = floor
elif surface_type == 3:
    out_window1 = window1
elif surface_type == 4:
    out_window2 = window2
elif surface_type == 5:
    out_window1 = window1
    out_window2 = window2
elif surface_type == 6:
    out_floor = floor
    out_window1 = window1
    out_window2 = window2
# ---------- end display_filter_surface ----------
# Filter what is displayed
display_filter_view = GhPythonScript(view_type=list_2, head_line=move_2.Head_points, head_rot=head_rot_3, gaze_rot=gaze_rot_3)  # -> out, out_head_line, out_head_rot, out_gaze_rot; inputs head_line: list, head_rot: list, gaze_rot: list
# ---------- display_filter_view: Python ----------
__author__ = "jsermari"
__version__ = "2023.02.03"

import rhinoscriptsyntax as rs
import Rhino

out_head_line = None
out_head_rot = None
out_gaze_rot = None

print("Test1")

if view_type == 1:
    pass
elif view_type == 2:
    out_gaze_rot = gaze_rot
elif view_type == 3:
    out_head_rot = head_rot
elif view_type == 4:
    print("Test2")
    out_head_line = head_line
    print("Test3")
    #print(head_line)
    print("Test4")
elif view_type == 5:
    out_gaze_rot = gaze_rot
    out_head_rot = head_rot
elif view_type == 6:
    out_gaze_rot = gaze_rot
    out_head_line = head_line
elif view_type == 7:
    out_head_rot = head_rot
    out_head_line = head_line
elif view_type == 8:
    out_head_line = head_line
    out_head_rot = head_rot
    out_gaze_rot = gaze_rot
# ---------- end display_filter_view ----------
item_5 = ListItem(List=end_2.End, Index=subtraction_3, Wrap=True)
# HEAD POS POINTS
merge = Merge(Data1=end_2.Start, Data2=item_5)

# ----
# Calculate Floor/Window view intersections
# Choose whether to use Eye or Head Rotation for intersection
panel_22 = Panel("0")
number_slider_6 = Slider(0.01, range=0..0.05)
vec_8 = VectorXYZ(XComponent=panel_22, YComponent=panel_22, ZComponent="-1")  # -> Vector, Length
gaze_lines = LineSDL(Start=merge, Direction=gaze_rot_3, Length="15")
standing_lines = LineSDL(Start=merge, Direction=vec_8.Vector, Length="15")
head_lines = LineSDL(Start=merge, Direction=head_rot_3, Length="15")
cull_2 = CullPattern(List=gaze_lines, CullPattern=facades_cull_pattern.cull_pattern)
cull_3 = CullPattern(List=head_lines, CullPattern=facades_cull_pattern.cull_pattern)
panel_23 = Panel("FLOOR (STANDING)")
panel_24 = Panel("FLOOR (VIEWING)")
panel_25 = Panel("WINDOW 2 (VIEWING)")
panel_26 = Panel("WINDOW 1 (VIEWING)")
head = SurfaceLine(Surface=display_filter_surface.out_floor, Line=standing_lines, LimitToFirst=False)  # -> Curves, Points, UVPoints, Normal
gaze = SurfaceLine(Surface=display_filter_surface.out_window1, Line=cull_2, LimitToFirst=False)  # -> Curves, Points, UVPoints, Normal
head_2 = SurfaceLine(Surface=display_filter_surface.out_floor, Line=cull_3, LimitToFirst=False)  # -> Curves, Points, UVPoints, Normal
gaze_2 = SurfaceLine(Surface=display_filter_surface.out_floor, Line=cull_2, LimitToFirst=False)  # -> Curves, Points, UVPoints, Normal
head_3 = SurfaceLine(Surface=display_filter_surface.out_window1, Line=cull_3, LimitToFirst=False)  # -> Curves, Points, UVPoints, Normal
head_4 = SurfaceLine(Surface=display_filter_surface.out_window2, Line=cull_3, LimitToFirst=False)  # -> Curves, Points, UVPoints, Normal
gaze_3 = SurfaceLine(Surface=display_filter_surface.out_window2, Line=cull_2, LimitToFirst=False)  # -> Curves, Points, UVPoints, Normal
dots = DotDisplay(Point=head_4.Points, Colour=head_color, Size=number_slider_6)
dots_2 = DotDisplay(Point=gaze_3.Points, Colour=eye_color, Size=number_slider_6)
dots_3 = DotDisplay(Point=head_2.Points, Colour=head_color, Size=number_slider_6)
dots_4 = DotDisplay(Point=gaze_2.Points, Colour=eye_color, Size=number_slider_6)
dots_5 = DotDisplay(Point=gaze.Points, Colour=eye_color, Size=number_slider_6)
dots_6 = DotDisplay(Point=head.Points, Colour=floor_color, Size=number_slider_6)
dots_7 = DotDisplay(Point=head_3.Points, Colour=head_color, Size=number_slider_6)
select_filter_intersections = GhPythonScript(head_rot_points=head_2.Points, eye_gaze_points=gaze_2.Points, picker=view_type)  # -> out, selected_points; inputs head_rot_points: list, eye_gaze_points: list
# ---------- select_filter_intersections: Python ----------
__author__ = "jsermari"
__version__ = "2023.04.11"

import rhinoscriptsyntax as rs

selected_points = []

if picker == 0:
    selected_points = head_rot_points
elif picker == 1:
    selected_points = eye_gaze_points
# ---------- end select_filter_intersections ----------
select_filter_intersections_2 = GhPythonScript(head_rot_points=head_3.Points, eye_gaze_points=gaze.Points, picker=view_type)  # -> out, selected_points; inputs head_rot_points: list, eye_gaze_points: list; same code as select_filter_intersections
select_filter_intersections_3 = GhPythonScript(head_rot_points=head_4.Points, eye_gaze_points=gaze_3.Points, picker=view_type)  # -> out, selected_points; inputs head_rot_points: list, eye_gaze_points: list; same code as select_filter_intersections

# ---- group: Make line thicker
vec_9 = VectorXYZ(XComponent="0", YComponent="0", ZComponent="0.01")  # -> Vector, Length
extr = Extrude(Base=move_2.Head_points, Direction=vec_9.Vector)

# ---- group: Conference
number_slider_7 = Slider(30, range=1..100)
number_slider_8 = Slider(60, range=1..100)
number_slider_9 = Slider(30, range=1..100)
number_slider_10 = Slider(20, range=1..100)
number_slider_11 = Slider(30, range=1..100)
number_slider_12 = Slider(20, range=1..100)
toggle = BooleanToggle(True)
toggle_2 = BooleanToggle(False)

# ---- group: Office
number_slider_13 = Slider(40, range=1..100)
number_slider_14 = Slider(60, range=1..100)
number_slider_15 = Slider(40, range=1..100)
number_slider_16 = Slider(40, range=1..100)
number_slider_17 = Slider(30, range=1..100)
number_slider_18 = Slider(20, range=1..100)
toggle_3 = BooleanToggle(True)
toggle_4 = BooleanToggle(False)

# ----
# CREDIT:
# Pieter Segeren
# https://www.grasshopper3d.com/forum/topics/help-for-counting-points-on-sub-surfaces?overrideMobileRedirect=1
floor = Window2(I=srf, U=number_slider_7, V=number_slider_8, P=select_filter_intersections.selected_points, trim_subdivisions=toggle_3)  # -> sub, domain_start, domain_end, t
window1 = Window2(
    I=boundary,
    U=number_slider_9,
    V=number_slider_10,
    P=select_filter_intersections_2.selected_points,
    trim_subdivisions=toggle_4)  # -> sub, domain_start, domain_end, t
window2 = Window2(
    I=boundary_2,
    U=number_slider_11,
    V=number_slider_12,
    P=select_filter_intersections_3.selected_points,
    trim_subdivisions=toggle_4)  # -> sub, domain_start, domain_end, t
number_slider_19 = Slider(0.02, range=0..1)
showif_2 = ShowIf(show=show_heatmaps, geom=flatten(floor.sub))  # -> out, out_geom; same code as showif
showif_3 = ShowIf(show=show_heatmaps, geom=flatten(window1.sub))  # -> out, out_geom; same code as showif
showif_4 = ShowIf(show=show_heatmaps, geom=flatten(window2.sub))  # -> out, out_geom; same code as showif
offset = OffsetSurface(Surface=showif_3.out_geom, Distance=number_slider_19, Retrim=True)
offset_2 = OffsetSurface(Surface=showif_4.out_geom, Distance=number_slider_19, Retrim=True)
gradient = Gradient(
    LowerLimit=window1.domain_start,
    UpperLimit=window1.domain_end,
    Parameter=flatten(window1.t),
    stops=[0: RGB(218, 243, 225), 0.1: RGB(114, 212, 173), 0.2: RGB(52, 148, 169), 0.3: RGB(57, 93, 156), 0.4: RGB(60, 48, 96), 0.5: RGB(17, 5, 10)])
gradient_2 = Gradient(
    LowerLimit=window2.domain_start,
    UpperLimit=window2.domain_end,
    Parameter=flatten(window2.t),
    stops=[0: RGB(218, 243, 225), 0.1: RGB(114, 212, 173), 0.2: RGB(52, 148, 169), 0.3: RGB(57, 93, 156), 0.4: RGB(60, 48, 96), 0.5: RGB(17, 5, 10)])
gradient_3 = Gradient(
    LowerLimit=floor.domain_start,
    UpperLimit=floor.domain_end,
    Parameter=flatten(floor.t),
    stops=[0: RGB(218, 243, 225), 0.1: RGB(114, 212, 173), 0.2: RGB(52, 148, 169), 0.3: RGB(57, 93, 156), 0.4: RGB(60, 48, 96), 0.5: RGB(17, 5, 10)])
preview_2 = CustomPreview(Geometry=showif_2.out_geom, Shader=gradient_3)
preview_3 = CustomPreview(Geometry=offset, Shader=gradient)
preview_4 = CustomPreview(Geometry=offset_2, Shader=gradient_2)

# ----
# CREDIT:
# Pieter Segeren
# https://www.grasshopper3d.com/forum/topics/help-for-counting-points-on-sub-surfaces?overrideMobileRedirect=1
number_slider_20 = Slider(30, range=1..100)
toggle_5 = BooleanToggle(False)
floor_2 = Window2(I=srf, U=number_slider_20, V=Slider(60, range=1..100), trim_subdivisions=Toggle(True))  # -> sub, domain_start, domain_end, t; disabled
window1_2 = Window2(I=boundary, U=Slider(30, range=1..100), V=Slider(20, range=1..100), trim_subdivisions=toggle_5)  # -> sub, domain_start, domain_end, t; disabled
window2_2 = Window2(I=boundary_2, U=Slider(30, range=1..100), V=Slider(20, range=1..100), trim_subdivisions=toggle_5)  # -> sub, domain_start, domain_end, t; disabled
number_slider_21 = Slider(0.02, range=0..1)
offset_3 = OffsetSurface(Surface=window1_2.sub, Distance=number_slider_21, Retrim=True)
offset_4 = OffsetSurface(Surface=window2_2.sub, Distance=number_slider_21, Retrim=True)
gradient_4 = Gradient(
    LowerLimit=window1_2.domain_start,
    UpperLimit=window1_2.domain_end,
    Parameter=flatten(window1_2.t),
    stops=[0: RGB(0, 128, 0), 0.327: RGB(255, 255, 0), 1: RGB(255, 0, 0)])
gradient_5 = Gradient(
    LowerLimit=window2_2.domain_start,
    UpperLimit=window2_2.domain_end,
    Parameter=flatten(window2_2.t),
    stops=[0: RGB(0, 128, 0), 0.327: RGB(255, 255, 0), 1: RGB(255, 0, 0)])
gradient_6 = Gradient(
    LowerLimit=floor_2.domain_start,
    UpperLimit=floor_2.domain_end,
    Parameter=flatten(floor_2.t),
    stops=[0: RGB(0, 128, 0), 0.327: RGB(255, 255, 0), 1: RGB(255, 0, 0)])
preview_5 = CustomPreview(Geometry=floor_2.sub, Shader=gradient_6)
preview_6 = CustomPreview(Geometry=offset_3, Shader=gradient_4)
preview_7 = CustomPreview(Geometry=offset_4, Shader=gradient_5)

floor_3 = Window2(I=srf, U=number_slider_7, V=number_slider_8, P=head.Points, trim_subdivisions=toggle_3)  # -> sub, domain_start, domain_end, t; disabled
gradient_7 = Gradient(
    LowerLimit=floor_3.domain_start,
    UpperLimit=floor_3.domain_end,
    Parameter=flatten(floor_3.t),
    stops=[0: RGB(245, 245, 245), 0.1: RGB(249, 140, 9), 0.2: RGB(189, 56, 83), 0.3: RGB(84, 19, 109), 0.4: RGB(0, 0, 3)])

panel_27 = Panel("R Virdis Color Palettes")
origina = Gradient(LowerLimit=0, UpperLimit=1, stops=[0: RGB(0, 128, 0), 0.327: RGB(255, 255, 0), 1: RGB(255, 0, 0)])
relay = Relay([showif_4.out_geom, showif_3.out_geom, showif_2.out_geom])
relay_2 = Relay([gradient_2, gradient, gradient_3])
max_3 = Maximum(A=floor.domain_end, B=window1.domain_end)
min_2 = Minimum(A=floor.domain_start, B=window1.domain_start)
merge_2 = Merge(Data1=floor.t, Data2=window1.t, Data3=window2.t)
min_3 = Minimum(A=min_2, B=window2.domain_start)
max_4 = Maximum(A=max_3, B=window2.domain_end)
subsurface_vals = Result(merge_2)
domain_min = Result(min_3)
domain_max = Result(max_4)

# ---- group: Gaze/Head rotation
remove_nulls = GhPythonScript(meshes_in=relay, colors_in=relay_2)  # -> out, meshes_out, colors_out; inputs meshes_in: list, colors_in: list
# ---------- remove_nulls: Python ----------
__author__ = "jsermari"
__version__ = "2023.04.16"

import rhinoscriptsyntax as rs

null_indexes = []
meshes_out = meshes_in
colors_out = colors_in

def remove_indexes(l, ind):
    print("Removing:", ind)
    for i in range(len(l), -1, -1):
        if i in ind:
            #print(i)
            l.pop(i)
    return(l)

if len(meshes_in) > 0:
    # Find nulls in geom
    for i in range(0, len(meshes_in)):
        if meshes_in[i] == None:
            null_indexes.append(i)
    # Remove null positions
    print(len(null_indexes))
    if len(null_indexes) > 0:
        meshes_out = remove_indexes(meshes_out, null_indexes)
        colors_out = remove_indexes(colors_out, null_indexes)
# ---------- end remove_nulls ----------
custom_bake = GhPythonScript(
    run=and,
    room=subjects_room,
    subject_type=subject_type,
    view_type=view_type,
    facade_type=facades_to_use,
    augmentation=subjects_augmentation,
    meshes=remove_nulls.meshes_out,
    colors=remove_nulls.colors_out)  # -> out, a; inputs meshes: list of Surface, colors: list
# ---------- custom_bake: Python ----------
__author__ = "jsermari"
__version__ = "2023.04.13"

import rhinoscriptsyntax as rs
import Rhino

# Script values
parent_layer_name = "Heatmaps"
rs.scriptcontext.doc = rs.Rhino.RhinoDoc.ActiveDoc

if run:
    # Get layer info
    facade_type_dict = {}
    facade_type_dict[0] = "NONE"
    facade_type_dict[1] = "OptimalFacades"
    facade_type_dict[2] = "PoorFacades"
    facade_type_dict[3] = "AllFacades"
    view_type_dict = {}
    view_type_dict[0] = "Head"
    view_type_dict[1] = "Eye"
    #layer_name = augmentation + "_" + facade_type_dict[facade_type] + "_" + view_type_dict[view_type]
    layer_name = subject_type + "_" + augmentation + "_" + facade_type_dict[facade_type] + "_" + view_type_dict[view_type]
    #assert rs.IsLayer(layer_name), "Layer (" + layer_name + ") was not found."
    # Create layer(s) if needed
    if not rs.IsLayer(parent_layer_name):
        rs.AddLayer(parent_layer_name)
    if not rs.IsLayer(layer_name):
        rs.AddLayer(layer_name, parent=parent_layer_name)
    
    # Remove old layer objects (if they exist)
    prev_objects = rs.ObjectsByLayer(layer_name)
    prev_count = len(prev_objects)
    for i in range(prev_count, 0, -1):
        rs.DeleteObject(prev_objects[i - 1])
    
    # Add objects to new layer
    for i in range(0, len(meshes)):
        mesh = meshes[i]
        color = colors[i]
        ##print(type(color))
        # Create object
        attr = Rhino.DocObjects.ObjectAttributes() # Default
        rhino_brep = rs.scriptcontext.doc.Objects.Add(mesh, attr)
        # Add material to objects
        mat_index = rs.ObjectMaterialIndex(rhino_brep)
        if mat_index == -1:
            mat_index = rs.AddMaterialToObject(rhino_brep)
        rs.MaterialColor(mat_index, color)
        # Put object on layer
        rs.ObjectLayer(rhino_brep, layer_name)
        #if(rs.IsLayer()
# ---------- end custom_bake ----------

# ---- group: Top-down position
remove_nulls_2 = GhPythonScript(meshes_in=floor_3.sub, colors_in=gradient_7)  # -> out, meshes_out, colors_out; inputs meshes_in: list, colors_in: list; same code as remove_nulls
preview_8 = CustomPreview(Geometry=remove_nulls_2.meshes_out, Shader=remove_nulls_2.colors_out)

# ----
panel_28 = Panel(custom_bake.out)
output_directory_of_the_heatmap_data_fil = Panel("C:\\Users\\jsermari\\Documents\\AR_Facades\\Data\\PostCHIExploration\\HeatmapData")  # "Output directory of the heatmap data files"
write_to_file_viewing = GhPythonScript(
    run=and_2,
    output_dir=output_directory_of_the_heatmap_data_fil,
    room=subjects_room,
    augmentation=subjects_augmentation,
    which_facades=facades_to_use,
    tracking_type=view_type,
    subject_type=subject_type,
    floor_s=floor.domain_start,
    floor_e=floor.domain_end,
    floor_l=floor.t,
    window1_s=window1.domain_start,
    window1_e=window1.domain_end,
    window1_l=window1.t,
    window2_s=window2.domain_start,
    window2_e=window2.domain_end,
    window2_l=window2.t)  # -> out, a; inputs floor_l: list, window1_l: list, window2_l: list
# ---------- write_to_file_viewing: Python ----------
__author__ = "jsermari"
__version__ = "2023.05.26"

import rhinoscriptsyntax as rs
import csv
import os

if run and (not(floor_l == None)) :
    # Generate file name
    tracking_type = "Head" if tracking_type == 0 else "Eye"
    file_name = "Viewing" + "_" + room + "_" + augmentation + "_" + str(which_facades) + "_" + tracking_type + "_" + subject_type.replace(" ", "") + ".csv"
    file_name = os.path.join(output_dir, file_name)
    # Write to file
    with open(file_name, 'wb') as csvfile:
        writer = csv.writer(csvfile, delimiter=',', quoting=csv.QUOTE_MINIMAL)
        header = ["Surface", "Type", "Facades", "s", "e", "l"]
        writer.writerow(header)
        for l in floor_l:
            row = ["Floor", tracking_type, which_facades, floor_s, floor_e, l]
            writer.writerow(row)
        for l in window1_l:
            row = ["Window1", tracking_type, which_facades, window1_s, window1_e, l]
            writer.writerow(row)
        for l in window2_l:
            row = ["Window2", tracking_type, which_facades, window2_s, window2_e, l]
            writer.writerow(row)
# ---------- end write_to_file_viewing ----------
write_to_file_standing = GhPythonScript(
    run=and_3,
    output_dir=output_directory_of_the_heatmap_data_fil,
    room=subjects_room,
    augmentation=subjects_augmentation,
    which_facades=facades_to_use,
    tracking_type=view_type,
    subject_type=subject_type,
    floor_s=floor_3.domain_start,
    floor_e=floor_3.domain_end,
    floor_l=floor_3.t)  # -> out, a; inputs floor_l: list
# ---------- write_to_file_standing: Python ----------
__author__ = "jsermari"
__version__ = "2023.05.26"

import rhinoscriptsyntax as rs
import csv
import os

if run and (not(floor_l == None)) :
    # Generate file name
    tracking_type = "Head" if tracking_type == 0 else "Eye"
    file_name = "Standing" + "_" + room + "_" + augmentation + "_" + str(which_facades) + "_" + tracking_type + "_" + subject_type.replace(" ", "") + ".csv"
    file_name = os.path.join(output_dir, file_name)
    # Write to file
    with open(file_name, 'wb') as csvfile:
        writer = csv.writer(csvfile, delimiter=',', quoting=csv.QUOTE_MINIMAL)
        header = ["Surface", "Type", "Facades", "s", "e", "l"]
        writer.writerow(header)
        for l in floor_l:
            row = ["Standing", "NA", which_facades, floor_s, floor_e, l]
            writer.writerow(row)
# ---------- end write_to_file_standing ----------
gradient_8 = Gradient(LowerLimit="0", UpperLimit="1", stops=[0: RGB(0, 128, 0), 0.327: RGB(255, 255, 0), 1: RGB(255, 0, 0)])
output_to_csv = GhPythonScript()  # -> Out, A
preview_9 = CustomPreview(Material=gradient_8)

# ----
# Color the line
# Start point
# End point
startpoint = Slider(0, range=0..10000)
panel_29 = Panel("Display")
panel_30 = Panel("HEAD POS")
panel_31 = Panel("HEAD ROT")
panel_32 = Panel("GAZE ROT")
lng_4 = ListLength(List=move_2.Head_points)
item_6 = ListItem(List=merge, Index=round.Nearest, Wrap=True)
item_7 = ListItem(List=head_rot_3, Index=round.Nearest, Wrap=True)
item_8 = ListItem(List=gaze_rot_3, Index=round.Nearest, Wrap=True)
dom = ConstructDomain(DomainStart=startpoint, DomainEnd=lng_4)
subtraction_4 = Subtraction(A=lng_4, B=startpoint)
range = Range(Domain=dom, Steps=subtraction_4)
showif_5 = GhPythonScript(show=show_highlight, geom=flatten(item_6))  # -> out, out_geom; same code as showif
showif_6 = GhPythonScript(show=show_highlight, geom=flatten(item_7))  # -> out, out_geom; same code as showif
showif_7 = GhPythonScript(show=show_highlight, geom=flatten(item_8))  # -> out, out_geom; same code as showif
gradient_9 = Gradient(
    LowerLimit=startpoint,
    UpperLimit=lng_4,
    Parameter=range,
    stops=[0: RGB(255, 0, 0), 0.254: RGB(255, 192, 192), 0.497: RGB(255, 255, 255), 0.751: RGB(192, 192, 255), 1: RGB(0, 0, 255)])
vdisex_7 = VectorDisplayEx(Point=merge, Vector=head_rot_3, Colour=head_color, Width=Slider(0.5, range=0.5..3))  # disabled
dots_8 = DotDisplay(Point=showif_5.out_geom, Colour=head_pos_color, Size=Slider(0.176, range=0..1))
vdisex_8 = VectorDisplayEx(Point=item_6, Vector=showif_6.out_geom, Colour=head_color_2, Width=Slider(2.35, range=0.5..3))
vdisex_9 = VectorDisplayEx(Point=merge, Vector=gaze_rot_3, Colour=eye_color, Width=Slider(0.5, range=0.5..3))
vdisex_10 = VectorDisplayEx(Point=item_6, Vector=showif_7.out_geom, Colour=eye_color_2, Width=Slider(2.35, range=0.5..3))

gradient_10 = Gradient(
    LowerLimit=startpoint,
    UpperLimit=lng_4,
    Parameter=range,
    stops=[0: RGB(245, 245, 245), 0.25: RGB(249, 140, 9), 0.5: RGB(189, 56, 83), 0.75: RGB(84, 19, 109), 1: RGB(0, 0, 3)])

preview_10 = CustomPreview(Geometry=extr, Material=gradient_10)

# ==== cluster Window2
trim_subdivisions = ClusterInput()
vec = VectorXYZ(XComponent="0", YComponent="0", ZComponent="1")  # -> Vector, Length
I = ClusterInput()
U = ClusterInput()
V = ClusterInput()
neg = Negative(Value=vec.Vector)
extr = Extrude(Base=I, Direction=vec.Vector)
divide = DivideDomain²(Domain=I, UCount=U, VCount=V)
division = Division(A=neg, B="2")
move = Move(Geometry=extr, Motion=division)  # -> Geometry, Transform
subsrf = Isotrim(Surface=I, Domain=divide)
tolerance = Slider(0.001, range=0..1)
P = ClusterInput()
brep_cp = BrepClosestPoint(Point=flatten(P), Brep=graft(subsrf), UseTasks=True)  # -> Point, Normal, Distance
shapein = ShapeInBrep(Brep=move.Geometry, Shape=subsrf)
smaller = SmallerThan(FirstNumber=brep_cp.Distance, SecondNumber=tolerance)  # -> SmallerThan, OrEqualTo
equals = Equality(FirstNumber=shapein, SecondNumber="1")  # -> Equality, Inequality
# Cull sections outside of needed area
equals_2 = Equality(FirstNumber=shapein, SecondNumber="0")  # -> Equality, Inequality
cull = CullPattern(List=brep_cp.Point, CullPattern=smaller.OrEqualTo)
or = GateOr(A=equals_2.Equality, B=equals.Equality)
lng = ListLength(List=cull)
cull_2 = CullPattern(List=flatten(lng), CullPattern=or)
cull_3 = CullPattern(List=subsrf, CullPattern=or)
filter = GhPythonScript(trim_subdivisions=trim_subdivisions, s1=subsrf, s2=cull_3)  # -> out, sub; inputs trim_subdivisions: Boolean, s1: list, s2: list
# ---------- filter: Python ----------
__author__ = "jsermari"
__version__ = "2023.02.07"

import rhinoscriptsyntax as rs

if trim_subdivisions:
    sub = s2
else:
    sub = s1
# ---------- end filter ----------
sub = ClusterOutput(filter.sub)
filter_2 = GhPythonScript(trim_subdivisions=trim_subdivisions, s1=flatten(lng), s2=cull_2)  # -> out, sub; inputs trim_subdivisions: Boolean, s1: list, s2: list; same code as filter
bnd = Bounds(Numbers=flatten(filter_2.sub))
domcomp = DomainComponents(Domain=bnd)  # -> Start, End
domain_end = ClusterOutput(domcomp.End)
domain_start = ClusterOutput(domcomp.Start)
t = ClusterOutput(filter_2.sub)
gradient = Gradient(
    LowerLimit=domcomp.Start,
    UpperLimit=domcomp.End,
    Parameter=flatten(filter_2.sub),
    stops=[0: RGB(0, 128, 0), 0.327: RGB(255, 255, 0), 1: RGB(255, 0, 0)])
