# Grasshopper definition PlotSubjectData_Single.gh (Grasshopper 1.0.7)

panel = Panel("C:\\Users\\jsermari\\Documents\\AR_Facades\\Data\\TestFiles")
# Log file
panel_2 = Panel("C:\\Users\\jsermari\\Documents\\AR_Facades\\Data\\Subjects\\\Log.csv")
# Subject's Data
panel_3 = Panel("C:\\Users\\jsermari\\Documents\\AR_Facades\\Data\\Subjects")
# Facade Rankings File (Generated by R and Pareto)
panel_4 = Panel("C:\\Users\\jsermari\\Documents\\AR_Facades\\Data\Rankings\\\FacadeOptimalData.csv")
# Reference Line (Facade bottom left)
experiment_reference_line = Line(Line((0.8644000002, 7.2262, 0.04440000016), (1.108212133, 7.2262, 0.04440000016)))
# Heatmap - View Type
list = ValueList({"Head Rotation": 0, "Eye Gaze": 1}, selected="Eye Gaze")
list_2 = ValueList({"Conference", "Office"}, selected="Conference")
list_3 = ValueList({"AR", "Desktop"}, selected="AR")
# Heatmap - Facades To Use
list_4 = ValueList({"None": 0, "Optimal": 1, "Poor": 2, "All": 3}, selected="All")
# Window 1 Curve
crv = Curve([<curve referenced from the Rhino model> x28])
# Floor Brep
brep = Brep(<brep referenced from the Rhino model>)
# Window 2 Curve
crv_2 = Curve([<curve referenced from the Rhino model> x22])
run = BooleanToggle(True)

# ----
# Subject's Directory
# Single
# Subject
panel_5 = Panel("62")
panel_6 = Panel("Jan13-2022_1")

debrep = DeconstructBrep(Brep=brep)  # -> Faces, Edges, Vertices
item = ListItem(List=debrep.Faces, Index=Slider(13, range=0..30), Wrap=True)
boundary = BoundarySurfaces(Edges=crv)
boundary_2 = BoundarySurfaces(Edges=crv_2)

# ----
# Multiple
# Subjects
generate_subjects_list = GhPythonScript(run=run, log_file_path=panel_2, room=list_2, augmentation=list_3)  # -> out, subjects_list
# ---------- generate_subjects_list: Python ----------
__author__ = "jsermari"
__version__ = "2023.04.12"

import rhinoscriptsyntax as rs
import os
import csv

# Outputs
subjects_list = []


if run == True:
    # Open file
    assert os.path.isfile(log_file_path), "ERROR: File " + log_file_path + " not found."
    print("Opening " + log_file_path)
    # Read subject data
    with open(log_file_path) as csvfile:
        reader = csv.reader(csvfile, delimiter=",")
        for row in reader:
            row_augmentation = row[6]
            row_room = row[7]
            if row_augmentation == augmentation and row_room == room:
                subjects_list.append(row[5])
        print(subjects_list)
        print(len(subjects_list))
    subjects_list = ["62", "36"]
    #subjects_list = ["62"]
# ---------- end generate_subjects_list ----------

concat = Concatenate(FragmentA=panel_3, FragmentB="\\", FragmentC=panel_5, FragmentD="\\")
# Set True to run
run_2 = BooleanToggle(True)
show_heatmaps = BooleanToggle(True)
# Facade height
panel_7 = Panel("2.651")
# Facade width
panel_8 = Panel("3.051")
t = Slider(0.55, range=0..1)
# Display Colors
head_pos_color = ColourSwatch(SwatchColor=RGB(245, 241, 5))
get_head_data = GhPythonScript(run=run_2, data_dir=concat, subject=panel_5)  # -> out, head_positions, head_rotations, facade_position, facade_rotation, gaze_positions, gaze_rotations, gaze_valids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
# ---------- get_head_data: Python ----------
__author__ = "John"
__version__ = "2023.01.18"

import rhinoscriptsyntax as rs
import Rhino
import csv
import os
from datetime import datetime
import math

datetime_format = '%H:%M:%S.%f'
"""
[
((pos_x,pos_y,pos_z), (rot_x,rot_y,rot_z), (gaze_pos_x, gaze_pos_y, gaze_pos_z), (gaze_rot_x, gaze_rot_y, gaze_rot_z), datetime, should_draw),
((pos_x,pos_y,pos_z), (rot_x,rot_y,rot_z), (gaze_pos_x, gaze_pos_y, gaze_pos_z), (gaze_rot_x, gaze_rot_y, gaze_rot_z), datetime, should_draw),
...
]
"""
# Input values
#head_data = []
#points = []
#head_rotations = []
# Output values
head_positions = []
head_rotations = []
facade_position = None
facade_rotation = None
gaze_positions = []
gaze_rotations = []
gaze_valids = []
timestamps = []
current_facades = []
facade_list = []
facade_timestamps = []
# Script values
rs.scriptcontext.doc = rs.Rhino.RhinoDoc.ActiveDoc
experiment_start_timestamp = None
# Column numbers for data files
COL_DATA_TYPE = 0
COL_TIME_CURRENT = 1
COL_TIMESTAMP = 2
COL_FACADE = 3
COL_HEAD_POS_X = 10
COL_HEAD_POS_Y = 11
COL_HEAD_POS_Z = 12
COL_HEAD_ROT_X = 13
COL_HEAD_ROT_Y = 14
COL_HEAD_ROT_Z = 15
COL_FACADE_POS_X = 16
COL_FACADE_POS_Y = 17
COL_FACADE_POS_Z = 18
COL_FACADE_ROT_X = 19
COL_FACADE_ROT_Y = 20
COL_FACADE_ROT_Z = 21
COL_GAZE_VALID = 22
COL_GAZE_POS_X = 23
COL_GAZE_POS_Y = 24
COL_GAZE_POS_Z = 25
COL_GAZE_ROT_X = 26
COL_GAZE_ROT_Y = 27
COL_GAZE_ROT_Z = 28
# Conversion ratio
conversion_factor = 0.01 # cm to m


def read_timestamp(cell_value):
    data = cell_value.strip()
    # Data
    date = data.split("-")[0]
    month = int(date.split("_")[1])
    day = int(date.split("_")[2])
    year = int(date.split("_")[0])
    # Time
    time = data.split("-")[1]
    hour = int(time.split(":")[0])
    minute = int(time.split(":")[1])
    second = int(time.split(":")[2].split(".")[0])
    millisecond = int(time.split(":")[2].split(".")[1])
    microsecond = millisecond * 1000
    
    return datetime(year, month, day, hour, minute, second, microsecond)

"""
def tranform_according_to_ref(x, y, z, ref_point, facade_pos):
    x_ref = ref_point[0]
    y_ref = ref_point[1]
    z_ref = ref_point[2]
    facade_x = facade_pos[0]
    facade_y = facade_pos[1]
    facade_z = facade_pos[2]
    # TODO
    return x, y, z
"""

##### MAIN #####
# Get subject data file
if run == True:
    subject_data_file = data_dir + "\\" + subject + ".csv"
    assert os.path.isfile(subject_data_file), "ERROR: File " + subject_data_file + " not found."
    print("Opening " + subject_data_file)
    """
    # Get facade position by reading last row in csv
    with open(subject_data_file) as csvfile:
        reader = csv.reader(csvfile, delimiter=",")
        i = 0 # May need for later
        for row in reader:
            if i == 0:
                i = i + 1
                continue
            if row[COL_FACADE_POS_X] != "":
                # Clear old values if necessary to reduce memory usage
                if facade_position != None:
                    del facade_position[:]
                if facade_rotation != None:
                    del facade_rotation[:]
                # Assign new values
                facade_position = [ \
                float(row[COL_FACADE_POS_X]),
                float(row[COL_FACADE_POS_Y]),
                float(row[COL_FACADE_POS_Z])]
                facade_rotation = [ \
                float(row[COL_FACADE_ROT_X]),
                float(row[COL_FACADE_ROT_Y]),
                float(row[COL_FACADE_ROT_Z])]
            i = i + 1
    """
    # Read subject data
    with open(subject_data_file) as csvfile:
        reader = csv.reader(csvfile, delimiter=",")
        for row in reader:
            type = row[COL_DATA_TYPE]
            if type=="GUI_Test_Complete":
                experiment_start_timestamp = read_timestamp(row[COL_TIMESTAMP])
                facade_list.append("fin_20_30") # Hardcoded as first
                facade_timestamps.append(experiment_start_timestamp)
            elif type == "Head":
                ## Determine if experiment had started
                if experiment_start_timestamp == None: #or timestamp <= experiment_start_timestamp:
                    continue
                ## Timestamp
                timestamp = read_timestamp(row[COL_TIMESTAMP])
                timestamps.append(timestamp)
                ## Head position
                head_pos_x = float(row[COL_HEAD_POS_X]) * conversion_factor
                head_pos_y = float(row[COL_HEAD_POS_Y]) * conversion_factor
                head_pos_z = float(row[COL_HEAD_POS_Z]) * conversion_factor
                # Swap y and z to convert from left handed (unreal) to right handed (rhino) coordinate system
                head_positions.append(Rhino.Geometry.Point3d(head_pos_x, head_pos_z, head_pos_y))
                ## Head rotation
                head_rot_x = float(row[COL_HEAD_ROT_X])
                head_rot_y = float(row[COL_HEAD_ROT_Y])
                head_rot_z = float(row[COL_HEAD_ROT_Z])
                # Swap y and z to convert from left handed (unreal) to right handed (rhino) coordinate system
                head_rotations.append(Rhino.Geometry.Point3d(head_rot_x, head_rot_z, head_rot_y))
                ## Facade position
                facade_pos_x = float(row[COL_FACADE_POS_X]) * conversion_factor
                facade_pos_y = float(row[COL_FACADE_POS_Y]) * conversion_factor
                facade_pos_z = float(row[COL_FACADE_POS_Z]) * conversion_factor
                # Swap y and z to convert from left handed (unreal) to right handed (rhino) coordinate system
                facade_position = Rhino.Geometry.Point3d(facade_pos_x, facade_pos_z, facade_pos_y) # Will always be overwritten
                ## Facade rotation
                facade_rot_x = float(row[COL_FACADE_ROT_X])
                facade_rot_y = float(row[COL_FACADE_ROT_Y])
                facade_rot_z = float(row[COL_FACADE_ROT_Z])
                # Swap y and z to convert from left handed (unreal) to right handed (rhino) coordinate system
                facade_rotation = Rhino.Geometry.Point3d(facade_rot_x, facade_rot_z, facade_rot_y) # Will always be overwritten
                ## Gaze position
                gaze_pos_x = float(row[COL_GAZE_POS_X]) * conversion_factor
                gaze_pos_y = float(row[COL_GAZE_POS_Y]) * conversion_factor
                gaze_pos_z = float(row[COL_GAZE_POS_Z]) * conversion_factor
                # Swap y and z to convert from left handed (unreal) to right handed (rhino) coordinate system
                gaze_positions.append(Rhino.Geometry.Point3d(gaze_pos_x, gaze_pos_z, gaze_pos_y))
                ## Gaze rotation
                gaze_rot_x = float(row[COL_GAZE_ROT_X])
                gaze_rot_y = float(row[COL_GAZE_ROT_Y])
                gaze_rot_z = float(row[COL_GAZE_ROT_Z])
                # Swap y and z to convert from left handed (unreal) to right handed (rhino) coordinate system
                gaze_rotations.append(Rhino.Geometry.Point3d(gaze_rot_x, gaze_rot_z, gaze_rot_y))
                ## Gaze visible
                gaze_valids.append((row[COL_GAZE_VALID].upper().strip() == "TRUE"))
                ## Currently active facade
                current_facades.append(facade_list[len(facade_list) - 1])
            elif type == "Settings_Changed":
                facade_list.append(row[COL_FACADE])
                facade_timestamps.append(read_timestamp(row[COL_TIMESTAMP]))
    
    """
    for i in range(0, len(head_data) - 1):
        #Rhino.Geometry.Point3d(
        points.append(Rhino.Geometry.Point3d(head_data[i][0][0], head_data[i][0][1], head_data[i][0][2]))
        head_rotations.append(Rhino.Geometry.Point3d(head_data[i][1][0], head_data[i][1][1], head_data[i][1][2]))
    """
# ---------- end get_head_data ----------
facades_data = GhPythonScript(rankings_filename=panel_4, current_room=list_2, facades=get_head_data.current_facades)  # -> out, is_optimal, rank; inputs facades: list
# ---------- facades_data: Python ----------
__author__ = "John"
__version__ = "2023.04.11"

import rhinoscriptsyntax as rs
import csv
import os


# Column numbers for data files
COL_FACADE = 0
COL_ROOM = 1
COL_ISOPTIMAL = 6
COL_RANK = 7
# Outputs
is_optimal = []
rank = []

# Create dict so CSV only needs to be opened once
facades_dict = {}
assert os.path.isfile(rankings_filename), "ERROR: File " + rankings_filename + " not found."
print("Opening " + rankings_filename)
with open(rankings_filename) as csvfile:
    reader = csv.reader(csvfile, delimiter=",")
    for row in reader:
        facades_dict[(row[COL_ROOM].upper(), row[COL_FACADE].upper())] = (row[COL_ISOPTIMAL], row[COL_RANK])
        #print(facades_dict)
# Search thru dict to match up values
for facade in facades:
    # Fix potential issues with rhino/R naming of facades
    if "facade1" in facade:
        facade = facade.replace("facade1", "dynamic")
    if "louver_hor" in facade:
        facade = facade.replace("louver_hor", "louver")
    if "10_75" in facade:
        facade = facade.replace("10_75", "10_70")
    if "20_75" in facade:
        facade = facade.replace("20_75", "20_70")
    # Generate output list values
    #print((current_room.upper(), facade.upper()))
    opt = facades_dict[(current_room.upper(), facade.upper())][0]
    opt = opt == "1"
    is_optimal.append(opt)
    r = int(facades_dict[(current_room.upper(), facade.upper())][1])
    rank.append(r)
# ---------- end facades_data ----------
# Highlights
show_highlight = BooleanToggle(False)
head_color_2 = ColourSwatch(SwatchColor=RGB(240, 38, 38))
head_color = ColourSwatch(SwatchColor=RGBA(196, 10, 10, 85))
eye_color_2 = ColourSwatch(SwatchColor=RGB(0, 148, 153))
floor_color = ColourSwatch(SwatchColor=RGB(255, 214, 48))
# Surface Type
list_5 = ValueList({"None": 1, "Floor": 2, "Window 1": 3, "Window 2": 4, "Window 1/2": 5, "All": 6}, selected="All")
eye_color = ColourSwatch(SwatchColor=RGBA(79, 249, 255, 85))
# View Type
list_6 = ValueList({"None": 1, "Eye": 2, "Head": 3, "Line": 4, "Eye/Head": 5, "Eye/Line": 6, "Head/Line": 7, "All": 8}, selected="Line")
facades_cull_pattern = GhPythonScript(is_optimal=facades_data.is_optimal, picker=list_4)  # -> out, cull_pattern; inputs is_optimal: list
# ---------- facades_cull_pattern: Python ----------
__author__ = "jsermari"
__version__ = "2023.04.11"

import rhinoscriptsyntax as rs

cull_pattern = []

for i in range(0, len(is_optimal)):
    if picker == 0:
        cull_pattern.append(False)
    elif picker == 1:
        cull_pattern.append(is_optimal[i])
    elif picker == 2:
        cull_pattern.append(not is_optimal[i])
    elif picker == 3:
        cull_pattern.append(True)
# ---------- end facades_cull_pattern ----------
panel_9 = Panel(get_head_data.out)
end = EndPoints(Curve=experiment_reference_line)  # -> Start, End
vec2pt = Vector2Pt(PointA=end.Start, PointB=end.End, Unitize=Toggle(True))  # -> Vector, Length
vdis = VectorDisplay(Anchor=end.Start, Vector=vec2pt.Vector)

# ----
# CREDIT:
# Pieter Segeren
# https://www.grasshopper3d.com/forum/topics/help-for-counting-points-on-sub-surfaces?overrideMobileRedirect=1
number_slider = Slider(30, range=1..100)
toggle = BooleanToggle(False)
floor = Window2(I=item, U=number_slider, V=Slider(60, range=1..100), trim_subdivisions=Toggle(True))  # -> sub, domain_start, domain_end, t; disabled
window1 = Window2(I=boundary, U=Slider(30, range=1..100), V=Slider(20, range=1..100), trim_subdivisions=toggle)  # -> sub, domain_start, domain_end, t; disabled
window2 = Window2(I=boundary_2, U=Slider(30, range=1..100), V=Slider(20, range=1..100), trim_subdivisions=toggle)  # -> sub, domain_start, domain_end, t; disabled
number_slider_2 = Slider(0.02, range=0..1)
offset = OffsetSurface(Surface=window1.sub, Distance=number_slider_2, Retrim=True)
offset_2 = OffsetSurface(Surface=window2.sub, Distance=number_slider_2, Retrim=True)
gradient = Gradient(
    LowerLimit=window1.domain_start,
    UpperLimit=window1.domain_end,
    Parameter=flatten(window1.t),
    stops=[0: RGB(0, 128, 0), 0.327: RGB(255, 255, 0), 1: RGB(255, 0, 0)])
gradient_2 = Gradient(
    LowerLimit=window2.domain_start,
    UpperLimit=window2.domain_end,
    Parameter=flatten(window2.t),
    stops=[0: RGB(0, 128, 0), 0.327: RGB(255, 255, 0), 1: RGB(255, 0, 0)])
gradient_3 = Gradient(
    LowerLimit=floor.domain_start,
    UpperLimit=floor.domain_end,
    Parameter=flatten(floor.t),
    stops=[0: RGB(0, 128, 0), 0.327: RGB(255, 255, 0), 1: RGB(255, 0, 0)])
preview = CustomPreview(Geometry=floor.sub, Shader=gradient_3)
preview_2 = CustomPreview(Geometry=offset, Shader=gradient)
preview_3 = CustomPreview(Geometry=offset_2, Shader=gradient_2)

# ----
# Highlight list index
# Data start
# Custom start
# End
# Custom end
panel_10 = Panel("Highlight (Range)")
lng = ListLength(List=get_head_data.timestamps)
panel_11 = Panel("End")
panel_12 = Panel("Start")
millisecond = Slider(0, range=0..999)
millisecond_2 = Slider(230, range=0..999)
second = Slider(0, range=0..59)
second_2 = Slider(0, range=0..59)
month = Slider(3, range=1..12)
minute = Slider(30, range=0..59)
month_2 = Slider(3, range=1..12)
minute_2 = Slider(0, range=0..59)
year = Slider(2022, range=2021..2023)
day = Slider(7, range=1..31)
year_2 = Slider(2022, range=2021..2023)
day_2 = Slider(7, range=1..31)
hour = Slider(18, range=0..23)
hour_2 = Slider(18, range=0..23)
subtraction = Subtraction(A=lng, B="1")
readtimestamp = GhPythonScript(timestamp_str=get_head_data.timestamps)  # -> out, year, month, day, hour, minute, second, microsecond; disabled
# ---------- readtimestamp: Python ----------
__author__ = "jsermari"
__version__ = "2023.02.06"

import rhinoscriptsyntax as rs
from datetime import datetime

timestamp = None

has_microsecond = "." in timestamp_str
if has_microsecond:
    timestamp = datetime.strptime(timestamp_str, '%Y-%m-%d %H:%M:%S.%f')
else:
    timestamp = datetime.strptime(timestamp_str, '%Y-%m-%d %H:%M:%S')
print(timestamp)

year = timestamp.year
month = timestamp.month
day = timestamp.day
hour = timestamp.hour
minute = timestamp.minute
second = timestamp.second
if has_microsecond:
    microsecond = timestamp.microsecond
else:
    microsecond = 0
# ---------- end readtimestamp ----------
item_2 = ListItem(List=get_head_data.timestamps, Index=subtraction, Wrap=True)
item_3 = ListItem(List=get_head_data.timestamps, Index="0", Wrap=True)
panel_13 = Panel(item_2)
panel_14 = Panel(item_3)
multiplication = Multiplication(A=millisecond, B="1000")
multiplication_2 = Multiplication(A=millisecond_2, B="1000")
createtimestamp = GhPythonScript(year=year, month=month, day=day, hour=hour, minute=minute, second=second, microsecond=multiplication)  # -> out, timestamp; inputs year: Int32, month: Int32, day: Int32, hour: Int32, minute: Int32, second: Int32, microsecond: Int32
# ---------- createtimestamp: Python ----------
__author__ = "jsermari"
__version__ = "2023.02.06"

import rhinoscriptsyntax as rs
from datetime import datetime

timestamp = datetime(year, month, day, hour, minute, second, microsecond)
# ---------- end createtimestamp ----------
createtimestamp_2 = GhPythonScript(year=year_2, month=month_2, day=day_2, hour=hour_2, minute=minute_2, second=second_2, microsecond=multiplication_2)  # -> out, timestamp; inputs year: Int32, month: Int32, day: Int32, hour: Int32, minute: Int32, second: Int32, microsecond: Int32; same code as createtimestamp
timestampculling = GhPythonScript(timestamps_all=get_head_data.timestamps, start=createtimestamp_2.timestamp, end=createtimestamp.timestamp)  # -> out, in_range; inputs timestamps_all: list
# ---------- timestampculling: Python ----------
__author__ = "jsermari"
__version__ = "2023.02.06"

import rhinoscriptsyntax as rs
from datetime import datetime

## Read timestamps
# START
has_microsecond = "." in start
if has_microsecond:
    start_timestamp = datetime.strptime(start, '%Y-%m-%d %H:%M:%S.%f')
else:
    start_timestamp = datetime.strptime(start, '%Y-%m-%d %H:%M:%S')
# END
has_microsecond = "." in end
if has_microsecond:
    end_timestamp = datetime.strptime(end, '%Y-%m-%d %H:%M:%S.%f')
else:
    end_timestamp = datetime.strptime(end, '%Y-%m-%d %H:%M:%S')

print("TIME START", start_timestamp)
print("TIME END", end_timestamp)

in_range = []
for i in range(0, len(timestamps_all)):
    t = timestamps_all[i]
    has_microsecond = "." in t
    if has_microsecond:
        t_timestamp = datetime.strptime(t, '%Y-%m-%d %H:%M:%S.%f')
    else:
        t_timestamp = datetime.strptime(t, '%Y-%m-%d %H:%M:%S')
        
    if(i == 0):
        print("CURRENT", t_timestamp)
    
    after_start = t_timestamp > start_timestamp
    before_end = t_timestamp < end_timestamp
    print("AFTER:", after_start)
    print("BEFORE:", before_end)
    if after_start and before_end:
        in_range.append(True)
    else:
        in_range.append(False)
# ---------- end timestampculling ----------
cull = CullPattern(List=get_head_data.timestamps, CullPattern=timestampculling.in_range)
createtimestamp_3 = GhPythonScript(
    year=readtimestamp.year,
    month=readtimestamp.month,
    day=readtimestamp.day,
    hour=readtimestamp.hour,
    minute=readtimestamp.minute,
    second=readtimestamp.second,
    microsecond=readtimestamp.microsecond)  # -> out, timestamp; same code as createtimestamp
panel_15 = Panel("Highlight (Single moment)")
lng_2 = ListLength(List=get_head_data.timestamps)
subtraction_2 = Subtraction(A=lng_2, B="1")
multiplication_3 = Multiplication(A=t, B=subtraction_2)
round = Round(Number=multiplication_3)  # -> Nearest, Floor, Ceiling
item_4 = ListItem(List=get_head_data.timestamps, Index=round.Nearest, Wrap=True)
getcurrentfacade = GhPythonScript(facade_list=get_head_data.facade_list, facade_timestamps=get_head_data.facade_timestamps, timestamp_current=item_4)  # -> out, facade_surface1, facade_surface2, facade_name, switched_time; inputs facade_list: list, facade_timestamps: list
# ---------- getcurrentfacade: Python ----------
__author__ = "jsermari"
__version__ = "2023.02.07"

import rhinoscriptsyntax as rs
from datetime import datetime

rs.scriptcontext.doc = rs.Rhino.RhinoDoc.ActiveDoc

def get_surfaces(facade_name):
    #print(rs.LayerChildren("facades::Pos1"))
    #rs.LayerId()
    
    facade_pos1 = None
    layer_name = "facades::Pos1" + "::" + facade_name
    facade_pos1 = rs.ObjectsByLayer(layer_name)
    #print(rs.ObjectsByLayer(layer_name))
    
    facade_pos2 = None
    if(rs.IsLayer("facades::Pos2")):
        layer_name = "facades::Pos2" + "::" + facade_name
        facade_pos2 = rs.ObjectsByLayer(layer_name)
    return facade_pos1, facade_pos2

has_microsecond = "." in timestamp_current
if has_microsecond:
    timestamp = datetime.strptime(timestamp_current, '%Y-%m-%d %H:%M:%S.%f')
else:
    timestamp = datetime.strptime(timestamp_current, '%Y-%m-%d %H:%M:%S')

facade_surface = None
facade_name = None
switched_time = None

# Find most recent active facade
for i in range(0, len(facade_list)):
    facade = facade_list[i]
    f_timestamp_str = facade_timestamps[i]
    
    has_microsecond = "." in f_timestamp_str
    if has_microsecond:
        f_timestamp = datetime.strptime(f_timestamp_str, '%Y-%m-%d %H:%M:%S.%f')
    else:
        f_timestamp = datetime.strptime(f_timestamp_str, '%Y-%m-%d %H:%M:%S')
    # Exit if needed
    if f_timestamp > timestamp:
        break
    # Update values
    facade_surfaces = get_surfaces(facade)
    facade_surface1 = facade_surfaces[0]
    facade_surface2 = facade_surfaces[1]
    facade_name = facade
    switched_time = f_timestamp
# ---------- end getcurrentfacade ----------
brep_2 = Brep(getcurrentfacade.facade_surface2)
brep_3 = Brep(getcurrentfacade.facade_surface1)
showif = GhPythonScript(show=show_highlight, geom=flatten([brep_2, brep_3]))  # -> out, out_geom
# ---------- showif: Python ----------
__author__ = "jsermari"
__version__ = "2023.02.07"

import rhinoscriptsyntax as rs

out_geom = None
if show:
    out_geom = geom
# ---------- end showif ----------
material = CreateMaterial(
    Diffuse=ColourSwatch(SwatchColor=RGB(208, 87, 235)),
    Specular=RGB(255, 255, 255),
    Emission=RGB(0, 0, 0),
    Transparency=Slider(0.662, range=0..1),
    Shine=0)
preview_4 = CustomPreview(Geometry=showif.out_geom, Material=material)

unrealtorhinoconv = UnrealToRhinoConv(
    head_positions_unreal=get_head_data.head_positions,
    head_rot_unreal=get_head_data.head_rotations,
    eye_rot_unreal=get_head_data.gaze_rotations,
    facade_position_unreal=get_head_data.facade_position,
    facade_rotation_unreal=get_head_data.facade_rotation,
    ref_line_start=end.Start,
    ref_vec=vec2pt.Vector)  # -> head_points, head_rot_4, eye_rot
end_2 = EndPoints(Curve=unrealtorhinoconv.head_points)  # -> Start, End
lng_3 = ListLength(List=end_2.End)
subtraction_3 = Subtraction(A=lng_3, B="1")
display_filter_surface = GhPythonScript(surface_type=list_5, floor=item, window1=boundary, window2=boundary_2)  # -> out, out_floor, out_window1, out_window2
# ---------- display_filter_surface: Python ----------
__author__ = "jsermari"
__version__ = "2023.02.03"

import rhinoscriptsyntax as rs
import Rhino

out_floor = None
out_window1 = None
out_window2 = None

if surface_type == 1:
    pass
elif surface_type == 2:
    out_floor = floor
elif surface_type == 3:
    out_window1 = window1
elif surface_type == 4:
    out_window2 = window2
elif surface_type == 5:
    out_window1 = window1
    out_window2 = window2
elif surface_type == 6:
    out_floor = floor
    out_window1 = window1
    out_window2 = window2
# ---------- end display_filter_surface ----------
display_filter_view = GhPythonScript(
    view_type=list_6,
    head_line=unrealtorhinoconv.head_points,
    head_rot=unrealtorhinoconv.head_rot_4,
    gaze_rot=unrealtorhinoconv.eye_rot)  # -> out, out_head_line, out_head_rot, out_gaze_rot
# ---------- display_filter_view: Python ----------
__author__ = "jsermari"
__version__ = "2023.02.03"

import rhinoscriptsyntax as rs
import Rhino

out_head_line = None
out_head_rot = None
out_gaze_rot = None

if view_type == 1:
    pass
elif view_type == 2:
    out_gaze_rot = gaze_rot
elif view_type == 3:
    out_head_rot = head_rot
elif view_type == 4:
    out_head_line = head_line
elif view_type == 5:
    out_gaze_rot = gaze_rot
    out_head_rot = head_rot
elif view_type == 6:
    out_gaze_rot = gaze_rot
    out_head_line = head_line
elif view_type == 7:
    out_head_rot = head_rot
    out_head_line = head_line
elif view_type == 8:
    out_head_line = head_line
    out_head_rot = head_rot
    out_gaze_rot = gaze_rot
# ---------- end display_filter_view ----------
item_5 = ListItem(List=end_2.End, Index=subtraction_3, Wrap=True)
merge = Merge(Data1=end_2.Start, Data2=item_5)

# ----
# Calculate Floor/Window view intersections
# Choose whether to use Eye or Head Rotation for intersection
panel_16 = Panel("0")
number_slider_3 = Slider(0.01, range=0..0.05)
vec = VectorXYZ(XComponent=panel_16, YComponent=panel_16, ZComponent="-1")  # -> Vector, Length
gaze_lines = LineSDL(Start=merge, Direction=unrealtorhinoconv.eye_rot, Length="15")
standing_lines = LineSDL(Start=merge, Direction=vec.Vector, Length="15")
head_lines = LineSDL(Start=merge, Direction=unrealtorhinoconv.head_rot_4, Length="15")
cull_2 = CullPattern(List=gaze_lines, CullPattern=facades_cull_pattern.cull_pattern)
cull_3 = CullPattern(List=head_lines, CullPattern=facades_cull_pattern.cull_pattern)
panel_17 = Panel("FLOOR (STANDING)")
panel_18 = Panel("FLOOR (VIEWING)")
panel_19 = Panel("WINDOW 2 (VIEWING)")
panel_20 = Panel("WINDOW 1 (VIEWING)")
head = SurfaceLine(Surface=display_filter_surface.out_floor, Line=standing_lines, LimitToFirst=False)  # -> Curves, Points, UVPoints, Normal
gaze = SurfaceLine(Surface=display_filter_surface.out_window1, Line=cull_2, LimitToFirst=False)  # -> Curves, Points, UVPoints, Normal
head_2 = SurfaceLine(Surface=display_filter_surface.out_floor, Line=cull_3, LimitToFirst=False)  # -> Curves, Points, UVPoints, Normal
gaze_2 = SurfaceLine(Surface=display_filter_surface.out_floor, Line=cull_2, LimitToFirst=False)  # -> Curves, Points, UVPoints, Normal
head_3 = SurfaceLine(Surface=display_filter_surface.out_window1, Line=cull_3, LimitToFirst=False)  # -> Curves, Points, UVPoints, Normal
head_4 = SurfaceLine(Surface=display_filter_surface.out_window2, Line=cull_3, LimitToFirst=False)  # -> Curves, Points, UVPoints, Normal
gaze_3 = SurfaceLine(Surface=display_filter_surface.out_window2, Line=cull_2, LimitToFirst=False)  # -> Curves, Points, UVPoints, Normal
dots = DotDisplay(Point=head_4.Points, Colour=head_color, Size=number_slider_3)
dots_2 = DotDisplay(Point=gaze_3.Points, Colour=eye_color, Size=number_slider_3)
dots_3 = DotDisplay(Point=head_2.Points, Colour=head_color, Size=number_slider_3)
dots_4 = DotDisplay(Point=gaze_2.Points, Colour=eye_color, Size=number_slider_3)
dots_5 = DotDisplay(Point=gaze.Points, Colour=eye_color, Size=number_slider_3)
dots_6 = DotDisplay(Point=head.Points, Colour=floor_color, Size=number_slider_3)
dots_7 = DotDisplay(Point=head_3.Points, Colour=head_color, Size=number_slider_3)
select_filter_intersections = GhPythonScript(head_rot_points=head_2.Points, eye_gaze_points=gaze_2.Points, picker=list)  # -> out, selected_points; inputs head_rot_points: list, eye_gaze_points: list
# ---------- select_filter_intersections: Python ----------
__author__ = "jsermari"
__version__ = "2023.04.11"

import rhinoscriptsyntax as rs

selected_points = []

if picker == 0:
    selected_points = head_rot_points
elif picker == 1:
    selected_points = eye_gaze_points
# ---------- end select_filter_intersections ----------
select_filter_intersections_2 = GhPythonScript(head_rot_points=head_3.Points, eye_gaze_points=gaze.Points, picker=list)  # -> out, selected_points; inputs head_rot_points: list, eye_gaze_points: list; same code as select_filter_intersections
select_filter_intersections_3 = GhPythonScript(head_rot_points=head_4.Points, eye_gaze_points=gaze_3.Points, picker=list)  # -> out, selected_points; inputs head_rot_points: list, eye_gaze_points: list; same code as select_filter_intersections

# ----
# Color the line
# Start point
# End point
startpoint = Slider(0, range=0..10000)
panel_21 = Panel("Display")
panel_22 = Panel("HEAD POS")
panel_23 = Panel("HEAD ROT")
panel_24 = Panel("GAZE ROT")
lng_4 = ListLength(List=unrealtorhinoconv.head_points)
item_6 = ListItem(List=merge, Index=round.Nearest, Wrap=True)
item_7 = ListItem(List=unrealtorhinoconv.head_rot_4, Index=round.Nearest, Wrap=True)
item_8 = ListItem(List=unrealtorhinoconv.eye_rot, Index=round.Nearest, Wrap=True)
dom = ConstructDomain(DomainStart=startpoint, DomainEnd=lng_4)
subtraction_4 = Subtraction(A=lng_4, B=startpoint)
range = Range(Domain=dom, Steps=subtraction_4)
showif_2 = GhPythonScript(show=show_highlight, geom=flatten(item_6))  # -> out, out_geom; same code as showif
showif_3 = GhPythonScript(show=show_highlight, geom=flatten(item_7))  # -> out, out_geom; same code as showif
showif_4 = GhPythonScript(show=show_highlight, geom=flatten(item_8))  # -> out, out_geom; same code as showif
gradient_4 = Gradient(
    LowerLimit=startpoint,
    UpperLimit=lng_4,
    Parameter=range,
    stops=[0: RGB(255, 0, 0), 0.254: RGB(255, 192, 192), 0.497: RGB(255, 255, 255), 0.751: RGB(192, 192, 255), 1: RGB(0, 0, 255)])
# HEAD POS LINE
# HEAD ROT
# HEAD POS POINTS
# EYE ROT
# Filter what is displayed
preview_5 = CustomPreview(Geometry=display_filter_view.out_head_line, Material=gradient_4)
vdisex = VectorDisplayEx(Point=merge, Vector=display_filter_view.out_head_rot, Colour=head_color, Width=Slider(0.5, range=0.5..3))
dots_8 = DotDisplay(Point=showif_2.out_geom, Colour=head_pos_color, Size=Slider(0.176, range=0..1))
vdisex_2 = VectorDisplayEx(Point=item_6, Vector=showif_3.out_geom, Colour=head_color_2, Width=Slider(2.35, range=0.5..3))
vdisex_3 = VectorDisplayEx(Point=merge, Vector=display_filter_view.out_gaze_rot, Colour=eye_color, Width=Slider(0.5, range=0.5..3))
vdisex_4 = VectorDisplayEx(Point=item_6, Vector=showif_4.out_geom, Colour=eye_color_2, Width=Slider(2.35, range=0.5..3))

# ----
# CREDIT:
# Pieter Segeren
# https://www.grasshopper3d.com/forum/topics/help-for-counting-points-on-sub-surfaces?overrideMobileRedirect=1
number_slider_4 = Slider(30, range=1..100)
toggle_2 = BooleanToggle(False)
floor_2 = Window2(
    I=item,
    U=number_slider_4,
    V=Slider(60, range=1..100),
    P=select_filter_intersections.selected_points,
    trim_subdivisions=Toggle(True))  # -> sub, domain_start, domain_end, t
window1_2 = Window2(
    I=boundary,
    U=Slider(30, range=1..100),
    V=Slider(20, range=1..100),
    P=select_filter_intersections_2.selected_points,
    trim_subdivisions=toggle_2)  # -> sub, domain_start, domain_end, t
window2_2 = Window2(
    I=boundary_2,
    U=Slider(30, range=1..100),
    V=Slider(20, range=1..100),
    P=select_filter_intersections_3.selected_points,
    trim_subdivisions=toggle_2)  # -> sub, domain_start, domain_end, t
number_slider_5 = Slider(0.02, range=0..1)
showif_5 = ShowIf(show=show_heatmaps, geom=flatten(floor_2.sub))  # -> out, out_geom; same code as showif
showif_6 = ShowIf(show=show_heatmaps, geom=flatten(window1_2.sub))  # -> out, out_geom; same code as showif
showif_7 = ShowIf(show=show_heatmaps, geom=flatten(window2_2.sub))  # -> out, out_geom; same code as showif
offset_3 = OffsetSurface(Surface=showif_6.out_geom, Distance=number_slider_5, Retrim=True)
offset_4 = OffsetSurface(Surface=showif_7.out_geom, Distance=number_slider_5, Retrim=True)
gradient_5 = Gradient(
    LowerLimit=window1_2.domain_start,
    UpperLimit=window1_2.domain_end,
    Parameter=flatten(window1_2.t),
    stops=[0: RGB(0, 128, 0), 0.327: RGB(255, 255, 0), 1: RGB(255, 0, 0)])
gradient_6 = Gradient(
    LowerLimit=window2_2.domain_start,
    UpperLimit=window2_2.domain_end,
    Parameter=flatten(window2_2.t),
    stops=[0: RGB(0, 128, 0), 0.327: RGB(255, 255, 0), 1: RGB(255, 0, 0)])
gradient_7 = Gradient(
    LowerLimit=floor_2.domain_start,
    UpperLimit=floor_2.domain_end,
    Parameter=flatten(floor_2.t),
    stops=[0: RGB(0, 128, 0), 0.327: RGB(255, 255, 0), 1: RGB(255, 0, 0)])
preview_6 = CustomPreview(Geometry=showif_5.out_geom, Shader=gradient_7)
preview_7 = CustomPreview(Geometry=offset_3, Shader=gradient_5)
preview_8 = CustomPreview(Geometry=offset_4, Shader=gradient_6)

max = Maximum(A=floor_2.domain_end, B=window1_2.domain_end)
min = Minimum(A=floor_2.domain_start, B=window1_2.domain_start)
merge_2 = Merge(Data1=floor_2.t, Data2=window1_2.t, Data3=window2_2.t)
min_2 = Minimum(A=min, B=window2_2.domain_start)
max_2 = Maximum(A=max, B=window2_2.domain_end)

# ==== cluster Window2
trim_subdivisions = ClusterInput()
vec = VectorXYZ(XComponent="0", YComponent="0", ZComponent="1")  # -> Vector, Length
I = ClusterInput()
U = ClusterInput()
V = ClusterInput()
neg = Negative(Value=vec.Vector)
extr = Extrude(Base=I, Direction=vec.Vector)
divide = DivideDomain²(Domain=I, UCount=U, VCount=V)
division = Division(A=neg, B="2")
move = Move(Geometry=extr, Motion=division)  # -> Geometry, Transform
subsrf = Isotrim(Surface=I, Domain=divide)
tolerance = Slider(0.001, range=0..1)
P = ClusterInput()
brep_cp = BrepClosestPoint(Point=flatten(P), Brep=graft(subsrf), UseTasks=True)  # -> Point, Normal, Distance
shapein = ShapeInBrep(Brep=move.Geometry, Shape=subsrf)
smaller = SmallerThan(FirstNumber=brep_cp.Distance, SecondNumber=tolerance)  # -> SmallerThan, OrEqualTo
equals = Equality(FirstNumber=shapein, SecondNumber="1")  # -> Equality, Inequality
equals_2 = Equality(FirstNumber=shapein, SecondNumber="0")  # -> Equality, Inequality
cull = CullPattern(List=brep_cp.Point, CullPattern=smaller.OrEqualTo)
or = GateOr(A=equals_2.Equality, B=equals.Equality)
lng = ListLength(List=cull)
bnd = Bounds(Numbers=flatten(lng))
cull_2 = CullPattern(List=subsrf, CullPattern=or)
filter = GhPythonScript(trim_subdivisions=trim_subdivisions, s1=subsrf, s2=cull_2)  # -> out, sub; inputs trim_subdivisions: Boolean, s1: list, s2: list
# ---------- filter: Python ----------
__author__ = "jsermari"
__version__ = "2023.02.07"

import rhinoscriptsyntax as rs

if trim_subdivisions:
    sub = s2
else:
    sub = s1
# ---------- end filter ----------
sub = ClusterOutput(filter.sub)
domcomp = DomainComponents(Domain=bnd)  # -> Start, End
domain_end = ClusterOutput(domcomp.End)
domain_start = ClusterOutput(domcomp.Start)
t = ClusterOutput(lng)
gradient = Gradient(
    LowerLimit=domcomp.Start,
    UpperLimit=domcomp.End,
    Parameter=flatten(lng),
    stops=[0: RGB(0, 128, 0), 0.327: RGB(255, 255, 0), 1: RGB(255, 0, 0)])

# ==== cluster UnrealToRhinoConv
head_positions_unreal = ClusterInput()
head_rot_unreal = ClusterInput()

# ----
# HEAD ROTATIONS (Unreal coordinates)
panel = Panel("Create Head Rotations")
pdecon = Deconstruct(Point=head_rot_unreal)  # -> XComponent, YComponent, ZComponent
eulertovec = EulerToVec(x=pdecon.XComponent, y=pdecon.YComponent, z=pdecon.ZComponent)  # -> out, vector
# ---------- eulertovec: Python ----------
__author__ = "John"
__version__ = "2023.01.23"

import rhinoscriptsyntax as rs
import Rhino
import math

# Output values
vector = None

## Convert degrees to radians
"""
pitch = math.radians(pitch)
yaw = math.radians(yaw)
roll = math.radians(roll)
"""
pitch = math.radians(z)
yaw = math.radians(y)
roll = math.radians(x)
## Convert from pitch/yaw/roll to vector
# https://stackoverflow.com/questions/1568568/how-to-convert-euler-angles-to-directional-vector

x_vec = math.cos(yaw) * math.cos(pitch)
y_vec = math.sin(yaw) * math.cos(pitch)
z_vec = math.sin(pitch)
"""
x = -math.cos(yaw) * math.sin(pitch) * math.sin(roll) - math.sin(yaw) * math.cos(roll)
y = -math.sin(yaw) * math.sin(pitch) * math.sin(roll) + math.cos(yaw) * math.cos(roll)
z =  math.cos(pitch) * math.sin(roll)
"""
vector = Rhino.Geometry.Point3d(x_vec, y_vec, z_vec)
# ---------- end eulertovec ----------

# ----
# GAZE ROTATIONS (Unreal coordinates)
panel_2 = Panel("Create Gaze Rotations")

# ----
# PATH (Unreal coordinates)
panel_3 = Panel("Create Head path")
cull_i = CullIndex(List=head_positions_unreal, Indices="-1", Wrap=True)
shift = ShiftList(List=head_positions_unreal, Shift="1", Wrap=Toggle(False))
ln = Line(StartPoint=cull_i, EndPoint=shift)

facade_position_unreal = ClusterInput()
facade_rotation_unreal = ClusterInput()
ref_line_start = ClusterInput()
ref_vec = ClusterInput()
eye_rot_unreal = ClusterInput()
# Convert from Unreal to Rhino Coordinates (Position)
# Convert from Euler to Vector
pdecon_2 = Deconstruct(Point=facade_rotation_unreal)  # -> XComponent, YComponent, ZComponent
python = GhPythonScript(pitch=pdecon_2.ZComponent, yaw=pdecon_2.YComponent, roll=pdecon_2.XComponent)  # -> out, vector
# ---------- python: Python ----------
__author__ = "John"
__version__ = "2023.01.23"

import rhinoscriptsyntax as rs
import Rhino
import math

# Output values
vector = None

## Convert degrees to radians
pitch = math.radians(pitch)
yaw = math.radians(yaw)
roll = math.radians(roll)
## Convert from pitch/yaw/roll to vector
# https://stackoverflow.com/questions/1568568/how-to-convert-euler-angles-to-directional-vector

x = math.cos(yaw) * math.cos(pitch)
y = math.sin(yaw) * math.cos(pitch)
z = math.sin(pitch)
"""
x = -math.cos(yaw) * math.sin(pitch) * math.sin(roll) - math.sin(yaw) * math.cos(roll)
y = -math.sin(yaw) * math.sin(pitch) * math.sin(roll) + math.cos(yaw) * math.cos(roll)
z =  math.cos(pitch) * math.sin(roll)
"""
vector = Rhino.Geometry.Point3d(x, y, z)
# ---------- end python ----------
eulertovec_2 = EulerToVec(x=pdecon_2.XComponent, y=pdecon_2.YComponent, z=pdecon_2.ZComponent)  # -> out, vector; same code as eulertovec
vdis = VectorDisplay(Anchor=facade_position_unreal, Vector=eulertovec_2.vector)
panel_4 = Panel("Create rotational vector")
pdecon_3 = Deconstruct(Point=eulertovec_2.vector)  # -> XComponent, YComponent, ZComponent
vec = VectorXYZ(XComponent=pdecon_3.XComponent, YComponent=pdecon_3.YComponent, ZComponent=pdecon_3.ZComponent)  # -> Vector, Length
unit = UnitVector(Vector=vec.Vector)
vdis_2 = VectorDisplay(Anchor=ref_line_start, Vector=unit)
panel_5 = Panel("Translate")
vec2pt = Vector2Pt(PointA=facade_position_unreal, PointB=ref_line_start, Unitize=False)  # -> Vector, Length
move = Move(Geometry=ln, Motion=vec2pt.Vector)  # -> Geometry, Transform
# Convert from Unreal to Rhino Coordinates (Rotation)
# ORDER:
# 1. XY Plane
# 2. XZ Plane
# 3. YZ Plane
pl = PlaneNormal(Origin=ref_line_start, ZAxis=unit)
pl_2 = PlaneNormal(Origin=ref_line_start, ZAxis=ref_vec)
deplane = DeconstructPlane(Plane=pl)  # -> Origin, XAxis, YAxis, ZAxis
# Reference Vectors
deplane_2 = DeconstructPlane(Plane=pl_2)  # -> Origin, XAxis, YAxis, ZAxis
neg = Negative(Value=deplane_2.XAxis)
swatch = ColourSwatch(SwatchColor=RGB(255, 36, 36))
number_slider = Slider(1, range=1..5)
number_slider_2 = Slider(1, range=1..5)
# Unreal Data
swatch_2 = ColourSwatch(SwatchColor=RGB(36, 167, 255))
neg_2 = Negative(Value=deplane_2.YAxis)
line = LineSDL(Start=deplane.Origin, Direction=deplane.XAxis, Length=1)
line_2 = LineSDL(Start=deplane.Origin, Direction=deplane.YAxis, Length=1)
line_3 = LineSDL(Start=deplane.Origin, Direction=deplane.ZAxis, Length=1)
vdisex = VectorDisplayEx(Point=deplane_2.Origin, Vector=deplane_2.ZAxis, Colour=swatch, Width=number_slider)
vdisex_2 = VectorDisplayEx(Point=deplane_2.Origin, Vector=deplane_2.XAxis, Colour=swatch, Width=number_slider)
vdisex_3 = VectorDisplayEx(Point=deplane_2.Origin, Vector=deplane_2.YAxis, Colour=swatch, Width=number_slider)
vdisex_4 = VectorDisplayEx(Point=deplane.Origin, Vector=deplane.XAxis, Colour=swatch_2, Width=number_slider_2)
vdisex_5 = VectorDisplayEx(Point=deplane.Origin, Vector=deplane.YAxis, Colour=swatch_2, Width=number_slider_2)
vdisex_6 = VectorDisplayEx(Point=deplane.Origin, Vector=deplane.ZAxis, Colour=swatch_2, Width=number_slider_2)
_0 = Number(0)
_1 = Number(1)
vec_2 = VectorXYZ(XComponent=_1, YComponent=_0, ZComponent=_0)  # -> Vector, Length
vec_3 = VectorXYZ(XComponent=_0, YComponent=_1, ZComponent=_0)  # -> Vector, Length
vec_4 = VectorXYZ(XComponent=_1, YComponent=_0, ZComponent=_0)  # -> Vector, Length
vec_5 = VectorXYZ(XComponent=_0, YComponent=_0, ZComponent=_1)  # -> Vector, Length
vec_6 = VectorXYZ(XComponent=_0, YComponent=_1, ZComponent=_0)  # -> Vector, Length
vec_7 = VectorXYZ(XComponent=_0, YComponent=_0, ZComponent=_1)  # -> Vector, Length
# XY
pl_3 = ConstructPlane(Origin=ref_line_start, XAxis=vec_2.Vector, YAxis=vec_3.Vector)
# XZ
pl_4 = ConstructPlane(Origin=ref_line_start, XAxis=vec_4.Vector, YAxis=vec_5.Vector)
# YZ
pl_5 = ConstructPlane(Origin=ref_line_start, XAxis=vec_6.Vector, YAxis=vec_7.Vector)
angle = Angle(VectorA=deplane.XAxis, VectorB=deplane_2.XAxis, Plane=pl_5)  # -> Angle, Reflex
min = Minimum(A=angle.Angle, B=angle.Reflex)
number_slider_3 = Slider(0, range=0..360)
number_slider_4 = Slider(91.534, range=0..360)
number_slider_5 = Slider(167.222, range=0..360)
rad = Radians(Degrees=Slider(91.481, range=0..360))
rad_2 = Radians(Degrees=Slider(95.586, range=0..360))
rad_3 = Radians(Degrees=Slider(0, range=0..360))
# Alignment Vectors
vrot = Rotate(Vector=deplane.XAxis, Axis=deplane_2.ZAxis, Angle=min)
head_rot = Rotate(Vector=eulertovec.vector, Axis=deplane_2.ZAxis, Angle=min)
gaze_rot = Rotate(Vector=eye_rot_unreal, Axis=deplane_2.ZAxis, Angle=min)
head_pos = Rotate3D(Geometry=move.Geometry, Angle=min, Center=ref_line_start, Axis=deplane_2.ZAxis)  # -> Geometry, Transform
vrot_2 = Rotate(Vector=deplane.YAxis, Axis=deplane_2.ZAxis, Angle=min)
vrot_3 = Rotate(Vector=deplane.ZAxis, Axis=deplane_2.ZAxis, Angle=min)
angle_2 = Angle(VectorA=vrot_3, VectorB=deplane_2.ZAxis, Plane=pl_3)  # -> Angle, Reflex
min_2 = Minimum(A=angle_2.Angle, B=angle_2.Reflex)
# Alignment Vectors
vrot_4 = Rotate(Vector=vrot, Axis=deplane_2.YAxis, Angle=angle_2.Angle)
head_pos_2 = Rotate3D(Geometry=head_pos.Geometry, Angle=angle_2.Angle, Center=ref_line_start, Axis=deplane_2.YAxis)  # -> Geometry, Transform
head_rot_2 = Rotate(Vector=head_rot, Axis=deplane_2.YAxis, Angle=angle_2.Angle)
gaze_rot_2 = Rotate(Vector=gaze_rot, Axis=deplane_2.YAxis, Angle=angle_2.Angle)
vrot_5 = Rotate(Vector=vrot_2, Axis=deplane_2.YAxis, Angle=angle_2.Angle)
vrot_6 = Rotate(Vector=vrot_3, Axis=deplane_2.YAxis, Angle=angle_2.Angle)
angle_3 = Angle(VectorA=vrot_6, VectorB=deplane_2.ZAxis, Plane=pl_4)  # -> Angle, Reflex
deg = Degrees(Radians=angle_3.Angle)
deg_2 = Degrees(Radians=angle_3.Reflex)
max = Maximum(A=angle_3.Angle, B=angle_3.Reflex)
# Alignment Vectors
vrot_7 = Rotate(Vector=vrot_4, Axis=deplane_2.XAxis, Angle=angle_3.Reflex)
head_rot_3 = Rotate(Vector=head_rot_2, Axis=deplane_2.XAxis, Angle=angle_3.Reflex)
gaze_rot_3 = Rotate(Vector=gaze_rot_2, Axis=deplane_2.XAxis, Angle=angle_3.Reflex)
head_pos_3 = Rotate3D(Geometry=head_pos_2.Geometry, Angle=angle_3.Reflex, Center=ref_line_start, Axis=deplane_2.XAxis)  # -> Geometry, Transform
vrot_8 = Rotate(Vector=vrot_5, Axis=deplane_2.XAxis, Angle=angle_3.Reflex)
vrot_9 = Rotate(Vector=vrot_6, Axis=deplane_2.XAxis, Angle=angle_3.Reflex)
vdis_3 = VectorDisplay(Anchor=ref_line_start, Vector=vrot)
vdis_4 = VectorDisplay(Anchor=ref_line_start, Vector=vrot_2)
vdis_5 = VectorDisplay(Anchor=ref_line_start, Vector=vrot_3)
vdis_6 = VectorDisplay(Anchor=ref_line_start, Vector=vrot_4)
vdis_7 = VectorDisplay(Anchor=ref_line_start, Vector=vrot_7)
vdis_8 = VectorDisplay(Anchor=ref_line_start, Vector=vrot_5)
vdis_9 = VectorDisplay(Anchor=ref_line_start, Vector=vrot_8)
vdis_10 = VectorDisplay(Anchor=ref_line_start, Vector=vrot_6)
vdis_11 = VectorDisplay(Anchor=ref_line_start, Vector=vrot_9)
eye_rot = ClusterOutput(gaze_rot_3)
head_rot_4 = ClusterOutput(head_rot_3)
X = Slider(0.5, range=-200..200)
Y = Slider(0, range=-200..200)
Z = Slider(0.5, range=-200..200)
# Apply position offsets to account for Unreal nudges
# Offsets in Unreal
panel_6 = Panel("CONF:")
pt = ConstructPoint(XCoordinate=X, YCoordinate=Y, ZCoordinate=Z)
pt_2 = ConstructPoint(XCoordinate="0", YCoordinate="0", ZCoordinate="0")
X_2 = Slider(0, range=-200..200)
Z_2 = Slider(0, range=-200..200)
panel_7 = Panel("OFFICE:")
Y_2 = Slider(0, range=-200..200)
pt_3 = ConstructPoint(XCoordinate=X_2, YCoordinate=Y_2, ZCoordinate=Z_2)
vec2pt_2 = Vector2Pt(PointA=pt_2, PointB=pt, Unitize=False)  # -> Vector, Length
move_2 = Move(Geometry=head_pos_3.Geometry, Motion=vec2pt_2.Vector)  # -> Head_points, Transform
head_points = ClusterOutput(move_2.Head_points)
