# Grasshopper definition sun.gh (Grasshopper 1.0.7)

epwmap = LBEPWmap(epw_map=Toggle(True))  # -> report; plug-in component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
panel = Panel("https://www.energyplus.net/weather-download/north_and_central_america_wmo_region_4/USA/FL/USA_FL_Orlando.Executive.AP.722053_TMY/all")
downloadepw = LBDownloadWeather(weather_URL=panel)  # -> epw_file, stat_file, ddy_file; plug-in component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
importepw = LBImportEPW(epw_file=downloadepw.epw_file)  # -> location, dry_bulb_temperature, dew_point_temperature, relative_humidity, wind_speed, wind_direction, direct_normal_rad, diffuse_horizontal_rad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; plug-in component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
number_slider = Slider(17, range=1..31)
number_slider_2 = Slider(12, range=1..12)
number_slider_3 = Slider(5, range=0..23)
hoy = LBCalculateHOY(month=number_slider_2, day=number_slider, hour=number_slider_3, minute=Slider(19, range=0..59))  # -> flatten(hoy), flatten(doy), flatten(date); plug-in component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
analysisperiod = LBAnalysisPeriod(
    start_month=number_slider_2,
    start_day=number_slider,
    start_hour=number_slider_3,
    end_month=number_slider_2,
    end_day=number_slider,
    end_hour=Slider(18, range=0..23),
    timestep=Slider(10, range=1..60))  # -> period, hoys, dates; plug-in component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
sunpath = LBSunPath(north=Slider(45, range=0..360), location=importepw.location, hoys=analysisperiod.hoys, scale=Slider(0.11, range=0..1))  # -> report, vectors, altitudes, azimuths, hoys, sun_pts, analemma, daily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; plug-in component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
geo = Geometry([<brep referenced from the Rhino model>, <mesh referenced from the Rhino model>, <brep referenced from the Rhino model>])
directsunhours = LBDirectSunHours(vectors=flatten(sunpath.vectors), geometry=flatten(geo), grid_size=Slider(0.25, range=0..10), run=Toggle(True))  # -> report, points, results, mesh, legend, title, int_mtx; plug-in component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
