# Grasshopper definition sun_rad.gh (Grasshopper 1.0.7)
# plug-ins: LunchBox

panel = Panel("https://www.energyplus.net/weather-download/north_and_central_america_wmo_region_4/USA/FL/USA_FL_Orlando.Executive.AP.722053_TMY/all")
ladybug = Ladybug_Ladybug()  # -> Vviiiiiiiiiizzz; plug-in component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
epw_stat = Ladybug_OpenEPWAndSTATWeatherFiles(weatherFileURL=panel)  # -> epwFile, statFile; plug-in component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
downloadepw = Ladybug_downloadEPWWeatherFile(download=Toggle(True))  # -> readMe; plug-in component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
panel_2 = Panel(ladybug)
# Generate Test Enviornment
panel_3 = Panel(downloadepw)
number_slider = Slider(9, range=0..23)
importepw = Ladybug_ImportEpw(epwFile=epw_stat.epwFile)  # -> readMe, latitude, location, dryBulbTemperature, dewPointTemperature, relativeHumidity, windSpeed, windDirection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; plug-in component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
number_slider_2 = Slider(12, range=1..12)
# Environment Settings
number_slider_3 = Slider(31, range=1..31)
# 4/2/2021 - Notes
# Conference Room
# Date: 12/31
# North: 184
# Office
# Date: 12/31
# North: 74
# ====================
number_slider_4 = Slider(74, range=0..360)
gradientlibrary = Ladybug_GradientLibrary(gradIndex=Slider(15, range=0..23))  # -> customColors; plug-in component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
# BEFORE:
# High bound: 0.65
# 
# 10000 lux = ~0.082
# 5000 lux = ~0.041
# 4800 lux = ~0.039
# 4000 lux = ~0.033
# 300 lux = ~0.0025
# 100 lux = ~0.0008
number_slider_5 = Slider(0.0008, range=0..100)
swatch = ColourSwatch(SwatchColor=RGB(0, 136, 255))
swatch_2 = ColourSwatch(SwatchColor=RGB(255, 255, 255))
swatch_3 = ColourSwatch(SwatchColor=RGB(255, 230, 230))
swatch_4 = ColourSwatch(SwatchColor=RGB(200, 255, 255))
swatch_5 = ColourSwatch(SwatchColor=RGB(255, 0, 0))
swatch_6 = ColourSwatch(SwatchColor=RGB(255, 255, 255))
swatch_7 = ColourSwatch(SwatchColor=RGB(255, 0, 0))
list = ValueList({"facade1_0", "facade1_30", "facade1_60", "facade1_90", "fin_10_30", "fin_10_70", "fin_20_30", "fin_20_70", "fritt_15_5", "fritt_15_10"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}, selected="facade1_0")
list_2 = ValueList({"Position 1": "Pos1", "Position 2": "Pos2"}, selected="Position 1")
# Settings
# Simulation Settings
list_3 = ValueList({"Conference": "conf", "P3 Office": "office"}, selected="P3 Office")
list_4 = ValueList({"9 AM": 9, "12 PM": 12, "3 PM": 15}, selected="9 AM")
doy_hoy = Ladybug_DOY_HOY(days=number_slider_3, months=number_slider_2, hours=list_4)  # -> HOY, DOY, date; plug-in component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
legendpar = Ladybug_LegendParameters(
    lowBound=number_slider_5,
    highBound=Slider(0.041, range=0..2),
    numSegments=Slider(11, range=2..20),
    customColors=flatten(gradientlibrary),
    decimalPlaces=Slider(4, range=2..20))  # -> legendPar; plug-in component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
number_slider_6 = Slider(2, range=0..2)
sunpath = Ladybug_SunPath(
    north=number_slider_4,
    location=importepw.location,
    hour=list_4,
    day=number_slider_3,
    month=number_slider_2,
    timeStep=1,
    sunPathScale=Slider(0.1, range=0..1.1),
    dailyOrAnnualSunPath=Toggle(True),
    bakeIt=number_slider_6)  # -> readMe, sunVectors, sunAltitudes, sunAzimuths, port, sunSpheresMesh, sunPathCrvs, compassCrvs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; plug-in component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
# Mesh Settings
# Test Geom
number_slider_7 = Slider(0.1, range=0..1)
# To Run:
# 1. Make sure environment setting are properly configured
# 2. Set floor to Test Geom
# 3. Set All scene geometry to Context
# 4. Ensure all necesssary directories are created
# 5. Ensure empty Excel workbook is open with proper name, proper facade sheet names, and CellData header
# 6. Set All Run Simulation toggles to TRUE
brep = Brep(<brep referenced from the Rhino model>)
# Context
brep_2 = Brep([<brep referenced from the Rhino model> x54])
# Run Simulation
# Run Simulation
toggle = BooleanToggle(False)
gencumulativeskymtx = Ladybug_GenCumulativeSkyMtx(epwFile=epw_stat.epwFile, skyDensity=0, useOldRes=Toggle(False), runIt=toggle)  # -> readMe, cumulativeSkyMtx; plug-in component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
panel_4 = Panel(gencumulativeskymtx.readMe)
selectskymtx = Ladybug_selectSkyMtx(cumulativeSkyMtx=gencumulativeskymtx.cumulativeSkyMtx, HOY=doy_hoy.HOY, removeDiffuse=False, removeDirect=False)  # -> readMe, selectedSkyMtx; plug-in component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
# Run Simulation
radiationanalysis = Ladybug_RadiationAnalysis(
    north=number_slider_4,
    geometry=flatten(brep),
    context=flatten(brep_2),
    gridSize=number_slider_7,
    disFromBase=Slider(0.1, range=-10..10),
    selectedSkyMtx=flatten(selectskymtx.selectedSkyMtx),
    legendPar=flatten(legendpar),
    parallel=Toggle(True),
    runIt=toggle,
    bakeIt=number_slider_6)  # -> readMe, contextMesh, analysisMesh, testPts, testVec, port, radiationResult, radiationMesh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; plug-in component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
panel_5 = Panel(radiationanalysis.readMe)
panel_6 = Panel(radiationanalysis.radiationResult)
panel_7 = Panel(radiationanalysis.totalRadiation)
# Run Texture Generation
toggle_2 = BooleanToggle(False)
# Run Excel Output
toggle_3 = BooleanToggle(False)
format = Format(Format=list_4, Culture=127)
concat = Concatenate(FragmentA="D:/RhinoExport/data/", FragmentB=list_3)
concat_2 = Concatenate(FragmentA=list_2, FragmentB="_")
concat_3 = Concatenate(FragmentA=concat, FragmentB="_")
concat_4 = Concatenate(FragmentA=concat_2, FragmentB=format)
concat_5 = Concatenate(FragmentA=concat_3, FragmentB=list_2)
concat_6 = Concatenate(FragmentA=concat_4, FragmentB="_")
int = Integer(0)
concat_7 = Concatenate(FragmentA="D:/RhinoExport/textures/", FragmentB=list_3)
concat_8 = Concatenate(FragmentA=concat_5, FragmentB=".xlsx")
concat_9 = Concatenate(FragmentA=concat_6, FragmentB=list)
panel_8 = Panel(concat_7)
# Excel Data Output
panel_9 = Panel(concat_8)
panel_10 = Panel(concat_9)
flatten = FlattenTree(Tree=radiationanalysis.radiationResult, Path="{0}")
# Texture Generation
nullrep = ReplaceNulls(Items=flatten, Replacements=int)  # -> Items, Count
texture_maker = Ladybug_TextureMaker(
    analysisMesh=flatten(radiationanalysis.radiationMesh),
    folder=panel_8,
    name=panel_10,
    layerName="baked",
    softBake=Toggle(True),
    bakeIt=toggle_2)  # -> readMe, imagePath, alphaPath, mesh; plug-in component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
panel_11 = Panel("D:/RhinoExport/conf")
excelwrite = ExcelWrite(
    WriteExcelData=toggle_3,
    WorkbookPath=panel_9,
    WorksheetName=panel_10,
    ColumnHeadings="CellData",
    Data=nullrep.Items,
    ClearSheet=Toggle(True))
panel_12 = Panel(excelwrite)
panel_13 = Panel(texture_maker.readMe)
