# Grasshopper definition sun_rad_old.gh (Grasshopper 1.0.7)

epwmap = LBEPWmap(epw_map=Toggle(True))  # -> report; plug-in component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
panel = Panel("https://www.energyplus.net/weather-download/north_and_central_america_wmo_region_4/USA/FL/USA_FL_Orlando.Executive.AP.722053_TMY/all")
downloadepw = LBDownloadWeather(weather_URL=panel)  # -> epw_file, stat_file, ddy_file; plug-in component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
importepw = LBImportEPW(epw_file=downloadepw.epw_file)  # -> location, dry_bulb_temperature, dew_point_temperature, relative_humidity, wind_speed, wind_direction, direct_normal_rad, diffuse_horizontal_rad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; plug-in component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
number_slider = Slider(45, range=0..360)
hoy = LBCalculateHOY(month=Slider(12, range=1..12), day=Slider(17, range=1..31), hour=Slider(14, range=0..23), minute=Slider(19, range=0..59))  # -> flatten(hoy), flatten(doy), flatten(date); plug-in component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
skymatrix = LBCumulativeSkyMatrix(
    north=number_slider,
    location=importepw.location,
    direct_rad=importepw.direct_normal_rad,
    diffuse_rad=importepw.diffuse_horizontal_rad,
    hoys=hoy.hoy)  # -> report, sky_mtx; plug-in component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
sunpath = LBSunPath(north=number_slider, location=importepw.location, hoys=hoy.hoy, scale=Slider(0.1, range=0..1.1))  # -> report, vectors, altitudes, azimuths, hoys, sun_pts, analemma, daily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; plug-in component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
colrange = LBColorRange(index=Slider(6, range=0..25))  # -> colors; plug-in component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
legendpar = LBLegendParameters(colors=colrange)  # -> leg_par; plug-in component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
geo = Geometry()
geo_2 = Geometry()
incidentradiation = LBIncidentRadiation(
    sky_mtx=skymatrix.sky_mtx,
    geometry=flatten(geo),
    context=flatten(geo_2),
    grid_size=Slider(0.25, range=0..1),
    offset_dist=Slider(0.1, range=0..1),
    legend_par=legendpar,
    run=Toggle(False))  # -> report, points, results, total, mesh, legend, title, int_mtx; plug-in component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
